# Grasshopper definition modifypts+make_topo.gh (Grasshopper 0.9.14)

panel = Panel("Building curve")
pipeline = GeometryPipeline(
    LayerFilter="PODPOLY-L",
    NameFilter="*",
    TypeFilter=4,
    IncludeLocked=True,
    IncludeHidden=True,
    GroupByLayer=False,
    GroupByType=False)
pipeline_2 = GeometryPipeline(
    LayerFilter="*",
    NameFilter="*",
    TypeFilter=0,
    IncludeLocked=True,
    IncludeHidden=True,
    GroupByLayer=False,
    GroupByType=False)
pipeline_3 = GeometryPipeline(
    LayerFilter="BLG",
    NameFilter="*",
    TypeFilter=4,
    IncludeLocked=True,
    IncludeHidden=True,
    GroupByLayer=False,
    GroupByType=False)
# Cross of Spot height
pipeline_4 = GeometryPipeline(
    LayerFilter="SPOTHT-Y",
    NameFilter="*",
    TypeFilter=4,
    IncludeLocked=True,
    IncludeHidden=True,
    GroupByLayer=False,
    GroupByType=False)
pipeline_5 = GeometryPipeline(LayerFilter="CONTOURS-LT", TypeFilter=4, IncludeLocked=True, IncludeHidden=True, GroupByLayer=False, GroupByType=False)
mcx = MultipleCurves(Curves=pipeline_4)  # -> Points, IndexA, IndexB, ParamA, ParamB
panel_3 = Panel(pipeline)
lng = ListLength(List=pipeline_3)
ins = ListInsert(List=pipeline_3, Item=pipeline, Indices=lng, Wrap=False)
cls = Closed(Curve=ins)  # -> Closed, Periodic
mindex = MemberIndex(Set=cls.Closed, Member=True)  # -> Index, Count
panel_4 = Panel(mindex.Index)
item = ListItem(List=ins, Index=mindex.Index, Wrap=False)
conex = ContainmentEx(Point=mcx.Points, Curves=item)  # -> Relationship, Index, Point
mindex_2 = MemberIndex(Set=conex.Relationship, Member=0)  # -> Index, Count
panel_5 = Panel(mindex_2.Index)
item_2 = ListItem(List=mcx.Points, Index=mindex_2.Index, Wrap=False)
panel_6 = Panel(item_2)
cullpt = CullDuplicates(Points=item_2, Tolerance=1, CullMode=3)  # -> Points, Indices, Valence
# Making Topography
pt = Point(cullpt.Points)
crv = Curve(pipeline_5)
divlength = DivideLength(Curve=crv, Length=Slider(5, range=0..50))  # -> flatten(Points), Tangents, Parameters
lng_2 = ListLength(List=pt)
ins_2 = ListInsert(List=pt, Item=divlength.Points, Indices=lng_2, Wrap=False)
del = DelaunayMesh(Points=ins_2, Plane=PlaneXY(0, 0, 0))
export_point = GeometryCache(cullpt.Points, MaintainReferences=False)
export_mesh = GeometryCache(del, MaintainReferences=False)
