# Grasshopper definition Calculate_ASE_for_LEED_hk.gh (Grasshopper 1.0.6)

# CLMATE INPUTS
ladybug = Ladybug_Ladybug()  # -> Vviiiiiiiiiizzz; plug-in component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

facade_geometry4 = Brep([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])
# GEOMETRIC INPUTS
facade_geometry1 = Brep([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])
facade_geometry2 = Brep([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])

facade_geometry3 = Brep(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)
# RUN THE STUDY
toggle = BooleanToggle(True)

daylight_threshold_lux = Panel("1000")
window_transmittance = Panel("0.6")

grid_size = Panel("0.25")
opaque_geometry = Brep(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)
test_surface = Brep(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)

facade_geometry = Brep(facade_geometry3)
open_weather_file = Ladybug_OpenEPWWeatherFile(open=Toggle(True))  # -> epwFile; plug-in component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
edges = BrepEdges(Brep=[opaque_geometry, test_surface, facade_geometry])  # -> Naked, Interior, NonManifold

# ----
# Make a statement to remove sun vectors
# below an illuminance threshold
panel = Panel("1")
division = Division(A=panel, B=window_transmittance)
multiplication = Multiplication(A=daylight_threshold_lux, B=division)
concat = Concatenate(FragmentA="a>", FragmentB=multiplication)
conditional_statement = Panel(concat)

# ----
# Import EPW and Define Analysis Period
importepw = Ladybug_ImportEpw(epwFile=open_weather_file)  # -> readMe, latitude, location, dryBulbTemperature, dewPointTemperature, relativeHumidity, windSpeed, windDirection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; plug-in component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
# Find Direct Illuminance
# in the Horizontal Plane
srfsolar = Ladybug_SurfaceHourlySolar(
    location=importepw.location,
    directNormal=importepw.directNormalIlluminance,
    diffuseHorizontal=importepw.diffuseHorizontalIlluminance)  # -> readMe, srfDirect, srfDiffuse, srfTotal, srfDirection; plug-in component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

# ----
# Account for the fact that illuminance is recorded at the end
# of each hour in the EPW by averaging the start and end of
# each hour (effectively interpolating between hours).
strnum = Ladybug_SeparateData(inputList=flatten(srfsolar.srfDirect))  # -> numbers, strings; plug-in component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
cull_i = CullIndex(List=strnum.numbers, Indices="0", Wrap=True)  # -> graft(List)
cull_i_2 = CullIndex(List=strnum.numbers, Indices="-1", Wrap=True)  # -> graft(List)
avr = Average(Input=[cull_i_2, cull_i])  # -> flatten(ArithmeticMean)
ins = InsertItems(List=avr, Item="0", Indices="-1", Wrap=True)
data = Data(flatten([strnum.strings, ins]))

# ----
# Get Sun Vectors for Hours Above Threshold
analysisperiod = Ladybug_AnalysisPeriod()  # -> readMe, analysisPeriod; plug-in component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
sunpath = Ladybug_SunPath(
    location=importepw.location,
    hour=12,
    day=21,
    month=12,
    timeStep=1,
    analysisPeriod=analysisperiod.analysisPeriod,
    sunPathScale="0.08",
    annualHourlyData=flatten(data),
    conditionalStatement=conditional_statement,
    dailyOrAnnualSunPath=True)  # -> readMe, sunVectors, sunAltitudes, sunAzimuths, port, sunSpheresMesh, sunPathCrvs, compassCrvs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; plug-in component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

# ----
# Select a Color Scheme
gradientlibrary = Ladybug_GradientLibrary(gradIndex="22")  # -> customColors; plug-in component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
legendpar = Ladybug_LegendParameters(lowBound="0", highBound="1000", customColors=flatten(gradientlibrary), decimalPlaces="0")  # -> legendPar; plug-in component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

# ----
# Get Sunlight Hours Hitting the Test Surface
panel_2 = Panel("0.0001")
sunlighthoursanalysis = Ladybug_SunlightHoursAnalysis(
    geometry=flatten(test_surface),
    context=flatten([opaque_geometry, facade_geometry]),
    gridSize=grid_size,
    disFromBase=panel_2,
    sunVectors=flatten(sunpath.sunVectors),
    timeStep=1,
    legendPar=flatten(legendpar),
    parallel=Toggle(True),
    runIt=toggle)  # -> readMe, contextMesh, analysisMesh, testPts, testVec, port, sunlightHoursResult, sunlightHoursMesh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; plug-in component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

meshselector = Ladybug_MeshThresholdSelector(
    inputMesh=sunlighthoursanalysis.sunlightHoursMesh,
    analysisResult=flatten(sunlighthoursanalysis.sunlightHoursResult),
    operator=">",
    levelOfPerform="250")  # -> readMe, totalValue, areaMeetsThresh, newColoredMesh, newMeshOutline; plug-in component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
# Calculate the Portion of the Space Below 250 Annual Hours
area = Area(Geometry=sunlighthoursanalysis.sunlightHoursMesh)  # -> Area, Centroid
division_2 = Division(A=meshselector.areaMeetsThresh, B=area.Area)
multiplication_2 = Multiplication(A=division_2, B="100")
int = Integer(multiplication_2)
preview = CustomPreview(Geometry=meshselector.newMeshOutline, Shader=ColourSwatch(SwatchColor=RGB(255, 255, 255)))
concat_2 = Concatenate(FragmentA=int, FragmentB="%")
portion_of_space_with_250_hours = Panel(concat_2)

panel_3 = Panel("""You can pass LEED with a narrative explaining additional glare
mitigation strategies.""")
larger = LargerThan(FirstNumber=multiplication_2, SecondNumber="20")  # -> LargerThan, OrEqualTo

larger_2 = LargerThan(FirstNumber=multiplication_2, SecondNumber="10")  # -> LargerThan, OrEqualTo

addition = Addition(A=larger_2.LargerThan, B=larger.LargerThan)

filter = StreamFilter(Gate=addition, Stream0="You have Passed LEED!", Stream1=panel_3, Stream2="You have Failed LEED.")
leed_status_of_your_geometry = Panel(filter)
