# Grasshopper definition Customizing_HVAC_Systems.gh (Grasshopper 1.0.7)

geo = Geometry([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])
mass2zone = Honeybee_Masses2Zones(zoneMasses=flatten(geo), isConditioned=True, maxRoofAngle=30, createHBZones=Toggle(True))  # -> readMe, HBZones; plug-in component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
# Set Up Zones
solveadjc = Honeybee_SolveAdjacencies(HBZones=flatten(mass2zone.HBZones), removeCurrentAdjc=False, findAdjc=Toggle(True))  # -> readMe, HBZonesWADJ; plug-in component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
glazingcreator = Honeybee_GlazingBasedOnRatio(HBObjects=solveadjc.HBZonesWADJ, glzRatio=Slider(0.5, range=0..1), breakUpWindow=Toggle(False), runIt=Toggle(True))  # -> readMe, HBObjWGLZ; plug-in component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

ladybug = Ladybug_Ladybug()  # -> Vviiiiiiiiiizzz; plug-in component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
honeybee = Honeybee_Honeybee()  # -> Vviiiiiiiiiizzz; plug-in component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

# ----
# Most HVAC Templates Support Air Recirculation
# To Model Spaces that Require Additional Air Filtering
# Like Clean Rooms + Hospital Patient Rooms
panel = Panel("2")
ach2m3_s_m2_calculator = Honeybee_infORventPerAreaCalculator(HBZones=flatten(glazingcreator.HBObjWGLZ), airFlowRate=panel)  # -> readMe, infORventPerArea, allFloors, allExposed; plug-in component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
setepzoneloads = Honeybee_SetEnergyPlusZoneLoads(
    HBZones=glazingcreator.HBObjWGLZ,
    ventilationPerArea=ach2m3_s_m2_calculator.infORventPerArea,
    ventilationPerPerson="0",
    recirculatedAirPerArea=ach2m3_s_m2_calculator.infORventPerArea)  # -> loads, HBZones; plug-in component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

# ----
# Adjust Thermostat Setpoints
# or Add Humidity Control
panel_2 = Panel("26")
panel_3 = Panel("19")
# Customize Zone-Level
# HVAC Parameters
setepzonethresholds = Honeybee_SetEnergyPlusZoneThresholds(HBZones=glazingcreator.HBObjWGLZ, coolingSetPt=panel_2, coolingSetback="28", maxHumidity="55")  # -> readMe, HBZones; plug-in component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

geo_2 = Geometry(setepzonethresholds.HBZones)

# ----
# If You Don't Want One Central System for All HBzones,
# Separate Zones into Data Tree Branches and
# Turn Off the "Flatten" on the HBZones Input.
# One System Will Be Assigned to Each Branch
# (Here, Each Floor Has a Separate VAV System)
openstudiohvacsystemslist = Honeybee_OpenStudioHVACSystemsList({"-1. Thermostat Only": -1, "0. Ideal Air Loads": 0, "1. PTAC | Residential": 1, "2. PTHP | Residential": 2, "3. Packaged Single Zone - AC": 3, "4. Packaged Single Zone - HP": 4, "5. Packaged VAV w/ Reheat": 5, "6. Packaged VAV w/ PFP Boxes": 6, "7. VAV w/ Reheat": 7, "8. VAV w/ PFP Boxes": 8, "9. Warm Air Furnace - Gas Fired": 9, "10.Warm Air Furnace - Electric": 10, "11.Fan Coil Units + DOAS": 11, "12.Active Chilled Beams + DOAS": 12, "13.Radiant Floors + DOAS": 13, "14.VRF + DOAS": 14}, selected="7. VAV w/ Reheat")
separatezonesbyfloor = Honeybee_SeparateZonesByFloor(HBZones=flatten(geo_2))  # -> floorHeights, HBZones; plug-in component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
hvacsystem = Honeybee_AssignHVACSystem(HBZones=separatezonesbyfloor.HBZones, HVACSystems=openstudiohvacsystemslist)  # -> readMe, HBZones; plug-in component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

# ----
# Customize Many of the Important
# Parameters of the HVAC
# (ie. Heat Recovery, Economizers, COPs,
#  and Availability Schedules)
panel_4 = Panel("1000")
coolingdetails = Honeybee_HVACCoolingDetails(coolingCOP="4.5")  # -> coolingDetails; plug-in component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
heatingdetails = Honeybee_HVACHeatingDetails(heatingEffOrCOP="0.9")  # -> heatingDetails; plug-in component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
airdetails = Honeybee_HVACAirDetails(fanPressureRise=panel_4, sensibleHeatRecovery="0.55")  # -> airDetails; plug-in component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

# ----
# Customize Bldg-Level
# or Floor- Level
# HVAC Parameters
# Choose from 14 HVAC Templates or
# Use "-1. Thermostat Only" to Build/Assign
# Your Own System in the OpenStudio Interface
openstudiohvacsystemslist_2 = Honeybee_OpenStudioHVACSystemsList({"-1. Thermostat Only": -1, "0. Ideal Air Loads": 0, "1. PTAC | Residential": 1, "2. PTHP | Residential": 2, "3. Packaged Single Zone - AC": 3, "4. Packaged Single Zone - HP": 4, "5. Packaged VAV w/ Reheat": 5, "6. Packaged VAV w/ PFP Boxes": 6, "7. VAV w/ Reheat": 7, "8. VAV w/ PFP Boxes": 8, "9. Warm Air Furnace - Gas Fired": 9, "10.Warm Air Furnace - Electric": 10, "11.Fan Coil Units + DOAS": 11, "12.Active Chilled Beams + DOAS": 12, "13.Radiant Floors + DOAS": 13, "14.VRF + DOAS": 14}, selected="7. VAV w/ Reheat")

hvacsystem_2 = Honeybee_AssignHVACSystem(
    HBZones=flatten(geo_2),
    HVACSystems=openstudiohvacsystemslist_2,
    airDetails=airdetails,
    heatingDetails=heatingdetails,
    coolingDetails=coolingdetails)  # -> readMe, HBZones; plug-in component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
panel_5 = Panel("https://www.energyplus.net/weather-download/north_and_central_america_wmo_region_4/USA/MA/USA_MA_Boston-Logan.Intl.AP.725090_TMY3/all")
toggle = BooleanToggle(True)

# ----
# Check to See that Your HVAC is Assigned
zoneattributelist = Honeybee_ZoneAttributeList({"Name": "name", "Zone Program": "zoneProgram", "Zone Floor Area": "zoneFloorArea", "Zone Volume": "zoneVolume", "Building Program": "bldgProgram", "Is Conditioned": "isConditioned", "HVAC System Type": "HVACSystem", "Occupancy Schedule": "occupancySchedule", "Occupancy Activity Schedule": "occupancyActivitySch", "Heating SetPoint Schedule": "heatingSetPtSchedule"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}, selected="HVAC System Type")
labelzones = Honeybee_LabelZones(HBZones=flatten(hvacsystem_2.HBZones), attribute=zoneattributelist)  # -> zoneTxtLabels, labelBasePts, brepTxtLabels, zoneWireFrames; plug-in component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

epoutput = Honeybee_GenerateEPOutput(
    zoneEnergyUse=toggle,
    zoneGainsAndLosses="False",
    zoneComfortMetrics="False",
    zoneHVACParams=toggle,
    surfaceTempAnalysis="False",
    timestep="monthly")  # -> report, flatten(simulationOutputs); plug-in component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
epw_stat = Ladybug_OpenEPWAndSTATWeatherFiles(weatherFileURL=panel_5)  # -> epwFile, statFile; plug-in component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

# ----
# Scale All Components of the HVAC
# and Specify Custom Design Days
panel_6 = Panel("0.8")
energysimpar = Honeybee_EnergySimulationPar(timestep=6, solarDistribution="4", heatingSizingFactor="0.7", coolingSizingFactor=panel_6)  # -> energySimPar; plug-in component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

toggle_2 = BooleanToggle(False)
exporttoopenstudio = Honeybee_ExportToOpenStudio(
    epwWeatherFile=epw_stat.epwFile,
    energySimPar=energysimpar,
    HBZones=flatten(hvacsystem_2.HBZones),
    simulationOutputs=flatten(epoutput.simulationOutputs),
    writeOSM=toggle_2,
    runSimulation=toggle_2,
    fileName="OpenStudioHVACTest")  # -> readMe, osmFileAddress, idfFileAddress, resultFileAddress, eioFileAddress, rddFileAddress, htmlReport, studyFolder, model; plug-in component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
panel_7 = Panel(exporttoopenstudio.readMe)
readepresult = Honeybee_ReadEPResult(resultFileAddress=exporttoopenstudio.resultFileAddress)  # -> totalThermalLoad, thermalLoadBalance, cooling, heating, electricLight, electricEquip, fanElectric, pumpElectric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; plug-in component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
# Visualize HVAC Operation
readep_hvac_result = Honeybee_ReadEPHVACResult(resultFileAddress=exporttoopenstudio.resultFileAddress)  # -> supplyVolFlow, supplyAirTemp, supplyAirHumidity, unmetHoursCooling, unmetHoursHeating; plug-in component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
flrnorm = Honeybee_NormalizeDataByFloorArea(simData=readepresult.cooling, HBZones=flatten(hvacsystem_2.HBZones))  # -> totNormData, zoneNormData; plug-in component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
flrnorm_2 = Honeybee_NormalizeDataByFloorArea(simData=readepresult.heating, HBZones=flatten(hvacsystem_2.HBZones))  # -> totNormData, zoneNormData; plug-in component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
flrnorm_3 = Honeybee_NormalizeDataByFloorArea(simData=readepresult.electricLight, HBZones=flatten(hvacsystem_2.HBZones))  # -> totNormData, zoneNormData; plug-in component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
flrnorm_4 = Honeybee_NormalizeDataByFloorArea(simData=readepresult.electricEquip, HBZones=flatten(hvacsystem_2.HBZones))  # -> totNormData, zoneNormData; plug-in component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
flrnorm_5 = Honeybee_NormalizeDataByFloorArea(simData=readepresult.fanElectric, HBZones=flatten(hvacsystem_2.HBZones))  # -> totNormData, zoneNormData; plug-in component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
flrnorm_6 = Honeybee_NormalizeDataByFloorArea(simData=readepresult.pumpElectric, HBZones=flatten(hvacsystem_2.HBZones))  # -> totNormData, zoneNormData; plug-in component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
airflow_volumes_at_every_node_of_the_hva = Panel(readep_hvac_result.unmetHoursCooling)  # "Airflow Volumes at Every Node of the HVAC"
# Calculate Site End-Use Intensity (EUI)
strnum = Ladybug_SeparateData(inputList=flatten([flrnorm.totNormData, flrnorm_2.totNormData, flrnorm_3.totNormData, flrnorm_4.totNormData, flrnorm_5.totNormData, flrnorm_6.totNormData]))  # -> numbers, strings; plug-in component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
ma = MassAddition(Input=strnum.numbers)  # -> flatten(Result), PartialResults
eui_si_kwh_m2 = Panel(ma.Result)
legendpar = Ladybug_LegendParameters(
    highBound="50",
    customColors=flatten([ColourSwatch(SwatchColor=RGB(0, 68, 110)), ColourSwatch(SwatchColor=RGB(166, 0, 0)), ColourSwatch(SwatchColor=RGB(0, 157, 255)), ColourSwatch(SwatchColor=RGB(255, 0, 0))]))  # -> legendPar; plug-in component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
# Plotting Unmet Hours
panel_8 = Panel("Unmet Hours (hours)")
ma_2 = MassAddition(Input=eui_si_kwh_m2)  # -> Result, PartialResults
eui_si_kwh_m2_2 = Panel(ma_2.Result)
barchart = Ladybug_MonthlyBarChart(
    inputData=flatten([readep_hvac_result.unmetHoursCooling, readep_hvac_result.unmetHoursHeating]),
    altYAxisTitle=panel_8,
    basePoint="0,50,0",
    legendPar=legendpar)  # -> readMe, dataMesh, dataCurves, dataCrvColors, graphAxes, graphLabels, title, titleBasePt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; plug-in component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
preview = CustomPreview(Geometry=barchart.graphAxes, Shader=ColourSwatch(SwatchColor=RGB(0, 0, 0)))

# ----
# Assign Custom Ventilation Schedules to Model
# Laboratory Fume Hoods or Other Scheduled Ventilation
lb_schedule = GenePool(
    Decimals=1,
    Maximum=1,
    Minimum=0,
    Value=[0.5, 0.5, 0.5, 0.5, 0.5, 0.5, 1, 1, 1, 1, 1, 1, 1, 1, 1, 1, 1, 1, 1, 1, 1, 0.5, 0.5, 0.5])
geo_3 = Geometry(glazingcreator.HBObjWGLZ)

constantschedule = Honeybee_ConstantSchedule(value=lb_schedule, scheduleName="LabVentilation")  # -> readMe, schedule, weekSched, schedIDFText; plug-in component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

setepzoneschedules = Honeybee_SetEnergyPlusZoneSchedules(HBZones=geo_3, ventilationSchedules=constantschedule.schedule)  # -> schedules, simplify(HBZones); plug-in component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
