# Grasshopper definition Daylight_Analysis_OvercastSky_for_OceanPark.gh (Grasshopper 1.0.6)

honeybee = Honeybee_Honeybee()  # -> Vviiiiiiiiiizzz; plug-in component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
brep = Brep([<brep referenced from the Rhino model> x5])
brep_2 = Brep([<brep referenced from the Rhino model> x25])
brep_3 = Brep(<brep referenced from the Rhino model>)
brep_4 = Brep([<brep referenced from the Rhino model> x5])
radopaquematerial = Honeybee_RadianceOpaqueMaterial(materialName="Proj", RReflectance="0.5", GReflectance="0.5", BReflectance="0.5", roughness=0.05, specularity=0)  # -> avrgRef, RADMaterial; plug-in component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
radopaquematerial_2 = Honeybee_RadianceOpaqueMaterial(materialName="ground", RReflectance="0", GReflectance="0", BReflectance="0", roughness=0.05, specularity=0)  # -> avrgRef, RADMaterial; plug-in component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
radopaquematerial_3 = Honeybee_RadianceOpaqueMaterial(materialName="surr", RReflectance="0.5", GReflectance="0.5", BReflectance="0.5", roughness=0.05, specularity=0)  # -> avrgRef, RADMaterial; plug-in component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
preview = CustomPreview(Geometry=brep, Material=ColourSwatch(SwatchColor=RGBA(255, 255, 255, 150)))
preview_2 = CustomPreview(Geometry=brep_3, Material=ColourSwatch(SwatchColor=RGBA(255, 255, 255, 150)))
preview_3 = CustomPreview(Geometry=brep_4, Material=ColourSwatch(SwatchColor=RGBA(255, 255, 255, 150)))
ladybug = Ladybug_Ladybug()  # -> Vviiiiiiiiiizzz; plug-in component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
gentestpts = Honeybee_GenerateTestPoints(testGeometry=brep_2, gridSize="2", distBaseSrf="0.1", moveTestMesh=True)  # -> readMe, simplify(testPoints), simplify(ptsVectors), simplify(facesArea), simplify(mesh); plug-in component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
genskyilluminancelevel = Honeybee_GenerateSkyWithCertainIlluminanceLevel(illuminanceValue="10000")  # -> skyFilePath; plug-in component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
radparameters = Honeybee_RADParameters(quality=0, ab="1")  # -> readMe, radParameters; plug-in component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
createhbsrfs = Honeybee_createHBSrfs(geometry=brep, RADMaterial=radopaquematerial.RADMaterial)  # -> readMe, simplify(HBSurface); plug-in component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
createhbsrfs_2 = Honeybee_createHBSrfs(geometry=brep_3, RADMaterial=radopaquematerial_2.RADMaterial)  # -> readMe, simplify(HBSurface); plug-in component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
createhbsrfs_3 = Honeybee_createHBSrfs(geometry=brep_4, RADMaterial=radopaquematerial_3.RADMaterial)  # -> readMe, simplify(HBSurface); plug-in component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
gridbasedsimulation = Honeybee_GridBasedSimulation(
    skyFile=genskyilluminancelevel,
    testPoints=gentestpts.testPoints,
    ptsVectors=gentestpts.ptsVectors,
    testMesh=gentestpts.mesh,
    simulationType="0",
    radParameters=radparameters.radParameters)  # -> analysisRecipe; plug-in component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
pt = Point(gentestpts.testPoints)
toggle = BooleanToggle(False)
brep_5 = Brep([createhbsrfs_2.HBSurface, createhbsrfs.HBSurface, createhbsrfs_3.readMe])
rundaylightanalysis = Honeybee_RunDaylightSimulation(
    HBObjects=flatten(brep_5),
    analysisRecipe=gridbasedsimulation,
    writeRad=toggle,
    runRad=toggle,
    workingDir="C:\ladybug_daylight",
    radFileName="TestCase",
    overwriteResults=True)  # -> readMe, analysisType, resultsUnit, results, testPts, resultFiles, radGeoFile, studyFolder, done; plug-in component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
mjoin = MeshJoin(Meshes=flatten(gentestpts.mesh))
data = Data(flatten(rundaylightanalysis.results))
panel = Panel(data)
gradientlibrary = Ladybug_GradientLibrary(gradIndex="2")  # -> customColors; plug-in component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
python = GhPythonScript(x=panel)  # -> out, a; inputs x: Int32
# ---------- python: Python ----------
__author__ = "WangXJ"
__version__ = "2018.12.20"

import rhinoscriptsyntax as rs

a=x/10000
# ---------- end python ----------
panel_2 = Panel(python.a)
legendpar = Ladybug_LegendParameters(lowBound="0", highBound="1", numSegments="21", customColors=flatten(gradientlibrary))  # -> legendPar; plug-in component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
recolormesh = Ladybug_RecolorMesh(
    analysisResult=panel_2,
    inputMesh=mjoin,
    legendPar=legendpar,
    analysisTitle="Daylight Factor",
    legendTitle="Daylight Factor")  # -> readMe, newMesh, newLegend, legendBasePt, meshColors, legendColors; plug-in component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
