# Grasshopper definition Full_Building_Energy_Simulation_freeWindow.gh (Grasshopper 1.0.6)

ladybug = Ladybug_Ladybug()  # -> Vviiiiiiiiiizzz; plug-in component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
honeybee = Honeybee_Honeybee()  # -> Vviiiiiiiiiizzz; plug-in component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

offices = Geometry([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])
classroom = Geometry([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])
storage = Geometry([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])
wrietup = Geometry(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)
lab_support = Geometry([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])
research_lab = Geometry([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])
conference = Geometry([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])
corridor = Geometry([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])
toggle = BooleanToggle(True)

# ----
# Lab Support
panel = Panel("Hospital::Lab")
mass2zone = Honeybee_Masses2Zones(zoneMasses=flatten(lab_support), zoneNames="LabSupport", zonePrograms=panel, maxRoofAngle=30, createHBZones=toggle)  # -> readMe, HBZones; plug-in component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
max_ach = Panel("6")
ach2m3_s_m2_calculator = Honeybee_infORventPerAreaCalculator(HBZones=flatten(mass2zone.HBZones), airFlowRate=max_ach)  # -> readMe, infORventPerArea, allFloors, allExposed; plug-in component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
m2_person = Panel("20")
equip_w_m2 = Panel("106")
light_w_m2 = Panel("10.5")
division = Division(A=1, B=m2_person)
setepzoneloads = Honeybee_SetEnergyPlusZoneLoads(
    HBZones=mass2zone.HBZones,
    equipmentLoadPerArea=equip_w_m2,
    lightingDensityPerArea=light_w_m2,
    numOfPeoplePerArea=division,
    ventilationPerArea=ach2m3_s_m2_calculator.infORventPerArea,
    ventilationPerPerson="0")  # -> loads, HBZones; plug-in component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
setepzoneschedules = Honeybee_SetEnergyPlusZoneSchedules(
    HBZones=setepzoneloads.HBZones,
    occupancySchedules="Labs21Occupancy Year Schedule",
    lightingSchedules="Labs21Lights Year Schedule",
    equipmentSchedules="Labs21Equip Year Schedule",
    ventilationSchedules="Labs21Ventilation Year Schedule")  # -> schedules, simplify(HBZones); plug-in component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
setepzonethresholds = Honeybee_SetEnergyPlusZoneThresholds(
    HBZones=setepzoneschedules.HBZones,
    coolingSetPt="23.9",
    coolingSetback="23.9",
    heatingSetPt="21.1",
    heatingSetback="21.1",
    maxHumidity="60")  # -> readMe, HBZones; plug-in component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
lab_zones = Geometry(flatten(setepzonethresholds.HBZones))

# ----
# Laboratory
panel_2 = Panel("Hospital::Lab")
mass2zone_2 = Honeybee_Masses2Zones(zoneMasses=flatten(research_lab), zoneNames="Lab", zonePrograms=panel_2, maxRoofAngle=30, createHBZones=toggle)  # -> readMe, HBZones; plug-in component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
max_ach_2 = Panel("6")
ach2m3_s_m2_calculator_2 = Honeybee_infORventPerAreaCalculator(HBZones=flatten(mass2zone_2.HBZones), airFlowRate=max_ach_2)  # -> readMe, infORventPerArea, allFloors, allExposed; plug-in component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
m2_person_2 = Panel("20")
equip_w_m2_2 = Panel("43")
light_w_m2_2 = Panel("10.5")
division_2 = Division(A=1, B=m2_person_2)
setepzoneloads_2 = Honeybee_SetEnergyPlusZoneLoads(
    HBZones=mass2zone_2.HBZones,
    equipmentLoadPerArea=equip_w_m2_2,
    lightingDensityPerArea=light_w_m2_2,
    numOfPeoplePerArea=division_2,
    ventilationPerArea=ach2m3_s_m2_calculator_2.infORventPerArea,
    ventilationPerPerson="0")  # -> loads, HBZones; plug-in component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
setepzoneschedules_2 = Honeybee_SetEnergyPlusZoneSchedules(
    HBZones=setepzoneloads_2.HBZones,
    occupancySchedules="Labs21Occupancy Year Schedule",
    lightingSchedules="Labs21Lights Year Schedule",
    equipmentSchedules="Labs21Equip Year Schedule",
    ventilationSchedules="Labs21Ventilation Year Schedule")  # -> schedules, simplify(HBZones); plug-in component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
setepzonethresholds_2 = Honeybee_SetEnergyPlusZoneThresholds(
    HBZones=setepzoneschedules_2.HBZones,
    coolingSetPt="23.9",
    coolingSetback="23.9",
    heatingSetPt="21.1",
    heatingSetback="21.1",
    maxHumidity="60")  # -> readMe, HBZones; plug-in component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
lab_zones_2 = Geometry(flatten(setepzonethresholds_2.HBZones))

# ----
# Classroom
panel_3 = Panel("SecondarySchool::Classroom")
mass2zone_3 = Honeybee_Masses2Zones(zoneMasses=flatten(classroom), zoneNames="Classroom", zonePrograms=panel_3, maxRoofAngle=30, createHBZones=toggle)  # -> readMe, HBZones; plug-in component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
m2_person_3 = Panel("1.5")
equip_w_m2_3 = Panel("11")
light_w_m2_3 = Panel("10.5")
division_3 = Division(A=1, B=m2_person_3)
setepzoneloads_3 = Honeybee_SetEnergyPlusZoneLoads(
    HBZones=mass2zone_3.HBZones,
    equipmentLoadPerArea=equip_w_m2_3,
    lightingDensityPerArea=light_w_m2_3,
    numOfPeoplePerArea=division_3)  # -> loads, HBZones; plug-in component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
setepzoneschedules_3 = Honeybee_SetEnergyPlusZoneSchedules(
    HBZones=setepzoneloads_3.HBZones,
    occupancySchedules="ClassroomPpl Year Schedule",
    heatingSetPtSchedules="AcaOfficeHeatSetPt Year Schedule",
    coolingSetPtSchedules="AcaOfficeCoolSetPt Year Schedule",
    lightingSchedules="ClassroomLight Year Schedule",
    equipmentSchedules="ClassroomEquip Year Schedule")  # -> schedules, simplify(HBZones); plug-in component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
classroom_zone = Geometry(flatten(setepzoneschedules_3.HBZones))

# ----
# Office
panel_4 = Panel("Office::ClosedOffice")
# Assign Loads + Schedules to Different Programs
mass2zone_4 = Honeybee_Masses2Zones(zoneMasses=flatten(offices), zoneNames="Office", zonePrograms=panel_4, maxRoofAngle=30, createHBZones=toggle)  # -> readMe, HBZones; plug-in component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
m2_person_4 = Panel("15")
equip_w_m2_4 = Panel("8")
light_w_m2_4 = Panel("8.5")
division_4 = Division(A=1, B=m2_person_4)
setepzoneloads_4 = Honeybee_SetEnergyPlusZoneLoads(
    HBZones=mass2zone_4.HBZones,
    equipmentLoadPerArea=equip_w_m2_4,
    lightingDensityPerArea=light_w_m2_4,
    numOfPeoplePerArea=division_4)  # -> loads, HBZones; plug-in component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
setepzoneschedules_4 = Honeybee_SetEnergyPlusZoneSchedules(
    HBZones=setepzoneloads_4.HBZones,
    occupancySchedules="AcaOfficeOcc Year Schedule",
    heatingSetPtSchedules="AcaOfficeHeatSetPt Year Schedule",
    coolingSetPtSchedules="AcaOfficeCoolSetPt Year Schedule",
    equipmentSchedules="AcaOfficeEquip Year Schedule")  # -> schedules, simplify(HBZones); plug-in component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
office_zones = Geometry(flatten(setepzoneschedules_4.HBZones))

# ----
# Writeup
panel_5 = Panel("Office::OpenOffice")
mass2zone_5 = Honeybee_Masses2Zones(zoneMasses=flatten(wrietup), zoneNames="WriteUp", zonePrograms=panel_5, maxRoofAngle=30, createHBZones=toggle)  # -> readMe, HBZones; plug-in component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
m2_person_5 = Panel("15")
equip_w_m2_5 = Panel("8")
light_w_m2_5 = Panel("8.5")
division_5 = Division(A=1, B=m2_person_5)
setepzoneloads_5 = Honeybee_SetEnergyPlusZoneLoads(
    HBZones=mass2zone_5.HBZones,
    equipmentLoadPerArea=equip_w_m2_5,
    lightingDensityPerArea=light_w_m2_5,
    numOfPeoplePerArea=division_5)  # -> loads, HBZones; plug-in component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
setepzoneschedules_5 = Honeybee_SetEnergyPlusZoneSchedules(
    HBZones=setepzoneloads_5.HBZones,
    occupancySchedules="Labs21Occupancy Year Schedule",
    heatingSetPtSchedules="AcaOfficeHeatSetPt Year Schedule",
    coolingSetPtSchedules="AcaOfficeCoolSetPt Year Schedule",
    lightingSchedules="Labs21Lights Year Schedule")  # -> schedules, simplify(HBZones); plug-in component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
writeup_zone = Geometry(flatten(setepzoneschedules_5.HBZones))

# ----
# Conference
panel_6 = Panel("Office::Conference")
mass2zone_6 = Honeybee_Masses2Zones(zoneMasses=flatten(conference), zoneNames="Conference", zonePrograms=panel_6, maxRoofAngle=30, createHBZones=toggle)  # -> readMe, HBZones; plug-in component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
m2_person_6 = Panel("15")
equip_w_m2_6 = Panel("8")
light_w_m2_6 = Panel("10")
division_6 = Division(A=1, B=m2_person_6)
setepzoneloads_6 = Honeybee_SetEnergyPlusZoneLoads(
    HBZones=mass2zone_6.HBZones,
    equipmentLoadPerArea=equip_w_m2_6,
    lightingDensityPerArea=light_w_m2_6,
    numOfPeoplePerArea=division_6)  # -> loads, HBZones; plug-in component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
setepzoneschedules_6 = Honeybee_SetEnergyPlusZoneSchedules(
    HBZones=setepzoneloads_6.HBZones,
    occupancySchedules="AcaOfficeOcc Year Schedule",
    heatingSetPtSchedules="AcaOfficeHeatSetPt Year Schedule",
    coolingSetPtSchedules="AcaOfficeCoolSetPt Year Schedule",
    equipmentSchedules="AcaOfficeEquip Year Schedule")  # -> schedules, simplify(HBZones); plug-in component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
conference_zone = Geometry(flatten(setepzoneschedules_6.HBZones))

# ----
# Corridor
panel_7 = Panel("Office::Corridor")
mass2zone_7 = Honeybee_Masses2Zones(zoneMasses=flatten(corridor), zoneNames="Corridor", zonePrograms=panel_7, maxRoofAngle=30, createHBZones=toggle)  # -> readMe, HBZones; plug-in component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
light_w_m2_7 = Panel("4")
setepzoneloads_7 = Honeybee_SetEnergyPlusZoneLoads(HBZones=mass2zone_7.HBZones, lightingDensityPerArea=light_w_m2_7)  # -> loads, HBZones; plug-in component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
setepzoneschedules_7 = Honeybee_SetEnergyPlusZoneSchedules(
    HBZones=setepzoneloads_7.HBZones,
    occupancySchedules="AcaOfficeOcc Year Schedule",
    heatingSetPtSchedules="AcaOfficeHeatSetPt Year Schedule",
    coolingSetPtSchedules="AcaOfficeCoolSetPt Year Schedule")  # -> schedules, simplify(HBZones); plug-in component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
corridorzone = Geometry(flatten(setepzoneschedules_7.HBZones))

# ----
# Storage
panel_8 = Panel("Office::Storage")
mass2zone_8 = Honeybee_Masses2Zones(zoneMasses=flatten(storage), zoneNames="Storage", zonePrograms=panel_8, maxRoofAngle=30, createHBZones=toggle)  # -> readMe, HBZones; plug-in component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
light_w_m2_8 = Panel("5.5")
setepzoneloads_8 = Honeybee_SetEnergyPlusZoneLoads(HBZones=mass2zone_8.HBZones, lightingDensityPerArea=light_w_m2_8)  # -> loads, HBZones; plug-in component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
setepzonethresholds_3 = Honeybee_SetEnergyPlusZoneThresholds(HBZones=setepzoneloads_8.HBZones, coolingSetPt="26.7", coolingSetback="26.7", heatingSetPt="15.6", heatingSetback="15.6")  # -> readMe, HBZones; plug-in component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
storagezone = Geometry(flatten(setepzonethresholds_3.HBZones))

mass2zone_9 = Honeybee_Masses2Zones(zoneMasses=flatten(corridor), zoneNames="Corridor", zonePrograms=panel_7, maxRoofAngle=30, createHBZones=toggle)  # -> readMe, HBZones; plug-in component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
mass2zone_10 = Honeybee_Masses2Zones(zoneMasses=flatten(offices), zoneNames="Office", zonePrograms=panel_4, maxRoofAngle=30, createHBZones=toggle)  # -> readMe, HBZones; plug-in component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
glzparamlist = Honeybee_GlazingParametersList(northGlzParam=0, westGlzParam=0, southGlzParam="0.5", eastGlzParam=0)  # -> glzParamList; plug-in component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
geo = Geometry([<brep referenced from the Rhino model> x2])
addhbglz = Honeybee_addHBGlz(HBObj=mass2zone_10.HBZones, childSurfaces=flatten(geo))  # -> HBObjWGLZ; plug-in component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
glazingcreator = Honeybee_GlazingBasedOnRatio(HBObjects=mass2zone_9.HBZones, glzRatio=glzparamlist, runIt=Toggle(True))  # -> readMe, HBObjWGLZ; plug-in component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
all_zones = Geometry(flatten([addhbglz, glazingcreator.HBObjWGLZ]))
decomposebytype = Honeybee_DecomposeBasedOnType(HBZone=all_zones)  # -> walls, interiorWalls, airWalls, windows, interiorWindows, skylights, roofs, ceilings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; plug-in component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
decomposebytype_2 = Honeybee_DecomposeBasedOnType()  # -> walls, interiorWalls, airWalls, windows, interiorWindows, skylights, roofs, ceilings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; plug-in component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
preview = CustomPreview(Geometry=decomposebytype.interiorWalls, Material=ColourSwatch(SwatchColor=RGB(25, 255, 255)))
preview_2 = CustomPreview(Geometry=decomposebytype.walls, Material=ColourSwatch(SwatchColor=RGB(120, 120, 120)))
preview_3 = CustomPreview(Geometry=decomposebytype.windows, Material=ColourSwatch(SwatchColor=RGB(25, 255, 255)))
preview_4 = CustomPreview(Geometry=decomposebytype.exposedFloors, Material=ColourSwatch(SwatchColor=RGB(110, 128, 128)))
preview_5 = CustomPreview(Geometry=decomposebytype_2.walls, Material=ColourSwatch(SwatchColor=RGB(120, 120, 120)))
preview_6 = CustomPreview(Geometry=decomposebytype_2.windows, Material=ColourSwatch(SwatchColor=RGB(25, 255, 255)))
preview_7 = CustomPreview(Geometry=decomposebytype_2.exposedFloors, Material=ColourSwatch(SwatchColor=RGB(110, 128, 128)))
all_zones_2 = Geometry(flatten([office_zones, writeup_zone, lab_zones, lab_zones_2, conference_zone, classroom_zone, corridorzone, storagezone]))

# ----
# Write Schedules
# Into the Memory
classroom_occupancy = Data(["""Schedule:Day:Interval,
	ClassroomPpl Day Schedule - Sun, !- Name
	Fractional, !- Schedule Type Limits Name
	No,        !- Interpolate to Timestep
	24:00,   !- Time 1 {hh:mm}
	0.0;     !- Value Until Time 1""", """Schedule:Day:Interval,
	ClassroomPpl Day Schedule - Mon, !- Name
	Fractional, !- Schedule Type Limits Name
	No,        !- Interpolate to Timestep
	8:00,   !- Time 1 {hh:mm}
	0.0,     !- Value Until Time 1
	9:00,   !- Time 2 {hh:mm}
	0.06,     !- Value Until Time 2
	10:00,   !- Time 3 {hh:mm}
	0.29,     !- Value Until Time 3
	12:00,   !- Time 4 {hh:mm}
	0.55,     !- Value Until Time 4
	13:00,   !- Time 5 {hh:mm}
	0.29,     !- Value Until Time 5
	16:00,   !- Time 6 {hh:mm}
	0.55,     !- Value Until Time 6
	17:00,   !- Time 7 {hh:mm}
	0.29,     !- Value Until Time 7
	18:00,   !- Time 8 {hh:mm}
	0.15,     !- Value Until Time 8
	21:00,   !- Time 9 {hh:mm}
	0.06,     !- Value Until Time 9
	24:00,   !- Time 10 {hh:mm}
	0.0;     !- Value Until Time 10""", """Schedule:Week:Daily,
	ClassroomPpl Week Schedule, !- Name
	ClassroomPpl Day Schedule - Sun,  !- Sunday Schedule:Day Name
	ClassroomPpl Day Schedule - Mon,  !- Monday Schedule:Day Name
	ClassroomPpl Day Schedule - Mon,  !- Tuesday Schedule:Day Name
	ClassroomPpl Day Schedule - Mon,  !- Wednesday Schedule:Day Name
	ClassroomPpl Day Schedule - Mon,  !- Thursday Schedule:Day Name
	ClassroomPpl Day Schedule - Mon,  !- Friday Schedule:Day Name
	ClassroomPpl Day Schedule - Sun,  !- Saturday Schedule:Day Name
	ClassroomPpl Day Schedule - Sun,  !- Holiday Schedule:Day Name
	ClassroomPpl Day Schedule - Mon,  !- SummerDesignDay Schedule:Day Name
	ClassroomPpl Day Schedule - Sun,  !- WinterDesignDay Schedule:Day Name
	ClassroomPpl Day Schedule - Sun,  !- CustomDay1 Schedule:Day Name
	ClassroomPpl Day Schedule - Sun;  !- CustomDay2 Schedule:Day Name""", """Schedule:Year,
	ClassroomPpl Year Schedule, !- Name
	Fractional, !- Schedule Type Limits Name
	ClassroomPpl Week Schedule,  !- Schedule:Week Name
	1,  !- Start Month 1
	1,  !- Start Day 1
	12,  !- End Month
	31;  !- End Day"""])
toggle_2 = BooleanToggle(True)
labs21occupancy = Data(["""Schedule:Day:Interval,
	Labs21Occupancy Day Schedule - Sun, !- Name
	Fractional, !- Schedule Type Limits Name
	No,        !- Interpolate to Timestep
	7:00,   !- Time 1 {hh:mm}
	0.05,     !- Value Until Time 1
	9:00,   !- Time 2 {hh:mm}
	0.1,     !- Value Until Time 2
	13:00,   !- Time 3 {hh:mm}
	0.3,     !- Value Until Time 3
	18:00,   !- Time 4 {hh:mm}
	0.1,     !- Value Until Time 4
	24:00,   !- Time 5 {hh:mm}
	0.05;     !- Value Until Time 5""", """Schedule:Day:Interval,
	Labs21Occupancy Day Schedule - Mon, !- Name
	Fractional, !- Schedule Type Limits Name
	No,        !- Interpolate to Timestep
	7:00,   !- Time 1 {hh:mm}
	0.05,     !- Value Until Time 1
	8:00,   !- Time 2 {hh:mm}
	0.1,     !- Value Until Time 2
	9:00,   !- Time 3 {hh:mm}
	0.2,     !- Value Until Time 3
	11:00,   !- Time 4 {hh:mm}
	0.9,     !- Value Until Time 4
	13:00,   !- Time 5 {hh:mm}
	0.45,     !- Value Until Time 5
	18:00,   !- Time 6 {hh:mm}
	0.9,     !- Value Until Time 6
	19:00,   !- Time 7 {hh:mm}
	0.3,     !- Value Until Time 7
	22:00,   !- Time 8 {hh:mm}
	0.1,     !- Value Until Time 8
	24:00,   !- Time 9 {hh:mm}
	0.05;     !- Value Until Time 9""", """Schedule:Day:Interval,
	Labs21Occupancy Day Schedule - HDD, !- Name
	Fractional, !- Schedule Type Limits Name
	No,        !- Interpolate to Timestep
	24:00,   !- Time 1 {hh:mm}
	0.0;     !- Value Until Time 1""", """Schedule:Week:Daily,
	Labs21Occupancy Week Schedule, !- Name
	Labs21Occupancy Day Schedule - Sun,  !- Sunday Schedule:Day Name
	Labs21Occupancy Day Schedule - Mon,  !- Monday Schedule:Day Name
	Labs21Occupancy Day Schedule - Mon,  !- Tuesday Schedule:Day Name
	Labs21Occupancy Day Schedule - Mon,  !- Wednesday Schedule:Day Name
	Labs21Occupancy Day Schedule - Mon,  !- Thursday Schedule:Day Name
	Labs21Occupancy Day Schedule - Mon,  !- Friday Schedule:Day Name
	Labs21Occupancy Day Schedule - Sun,  !- Saturday Schedule:Day Name
	Labs21Occupancy Day Schedule - Sun,  !- Holiday Schedule:Day Name
	Labs21Occupancy Day Schedule - Mon,  !- SummerDesignDay Schedule:Day Name
	Labs21Occupancy Day Schedule - HDD,  !- WinterDesignDay Schedule:Day Name
	Labs21Occupancy Day Schedule - Sun,  !- CustomDay1 Schedule:Day Name
	Labs21Occupancy Day Schedule - Sun;  !- CustomDay2 Schedule:Day Name""", """Schedule:Year,
	Labs21Occupancy Year Schedule, !- Name
	Fractional, !- Schedule Type Limits Name
	Labs21Occupancy Week Schedule,  !- Schedule:Week Name
	1,  !- Start Month 1
	1,  !- Start Day 1
	12,  !- End Month
	31;  !- End Day"""])
labs21ventilation = Data(["""Schedule:Day:Interval,
	Labs21Ventilation Day Schedule - Sun, !- Name
	Fractional, !- Schedule Type Limits Name
	No,        !- Interpolate to Timestep
	9:00,   !- Time 1 {hh:mm}
	0.5,     !- Value Until Time 1
	13:00,   !- Time 2 {hh:mm}
	1.0,     !- Value Until Time 2
	24:00,   !- Time 3 {hh:mm}
	0.5;     !- Value Until Time 3""", """Schedule:Day:Interval,
	Labs21Ventilation Day Schedule - Mon, !- Name
	Fractional, !- Schedule Type Limits Name
	No,        !- Interpolate to Timestep
	8:00,   !- Time 1 {hh:mm}
	0.5,     !- Value Until Time 1
	19:00,   !- Time 2 {hh:mm}
	1.0,     !- Value Until Time 2
	24:00,   !- Time 3 {hh:mm}
	0.5;     !- Value Until Time 3""", """Schedule:Week:Daily,
	Labs21Ventilation Week Schedule, !- Name
	Labs21Ventilation Day Schedule - Sun,  !- Sunday Schedule:Day Name
	Labs21Ventilation Day Schedule - Mon,  !- Monday Schedule:Day Name
	Labs21Ventilation Day Schedule - Mon,  !- Tuesday Schedule:Day Name
	Labs21Ventilation Day Schedule - Mon,  !- Wednesday Schedule:Day Name
	Labs21Ventilation Day Schedule - Mon,  !- Thursday Schedule:Day Name
	Labs21Ventilation Day Schedule - Mon,  !- Friday Schedule:Day Name
	Labs21Ventilation Day Schedule - Sun,  !- Saturday Schedule:Day Name
	Labs21Ventilation Day Schedule - Sun,  !- Holiday Schedule:Day Name
	Labs21Ventilation Day Schedule - Mon,  !- SummerDesignDay Schedule:Day Name
	Labs21Ventilation Day Schedule - Mon,  !- WinterDesignDay Schedule:Day Name
	Labs21Ventilation Day Schedule - Sun,  !- CustomDay1 Schedule:Day Name
	Labs21Ventilation Day Schedule - Sun;  !- CustomDay2 Schedule:Day Name""", """Schedule:Year,
	Labs21Ventilation Year Schedule, !- Name
	Fractional, !- Schedule Type Limits Name
	Labs21Ventilation Week Schedule,  !- Schedule:Week Name
	1,  !- Start Month 1
	1,  !- Start Day 1
	12,  !- End Month
	31;  !- End Day"""])
classroom_equip = Data(["""Schedule:Day:Interval,
	ClassroomEquip Day Schedule - Sun, !- Name
	Fractional, !- Schedule Type Limits Name
	No,        !- Interpolate to Timestep
	24:00,   !- Time 1 {hh:mm}
	0.0;     !- Value Until Time 1""", """Schedule:Day:Interval,
	ClassroomEquip Day Schedule - Mon, !- Name
	Fractional, !- Schedule Type Limits Name
	No,        !- Interpolate to Timestep
	8:00,   !- Time 1 {hh:mm}
	0.05,     !- Value Until Time 1
	9:00,   !- Time 2 {hh:mm}
	0.06,     !- Value Until Time 2
	10:00,   !- Time 3 {hh:mm}
	0.29,     !- Value Until Time 3
	12:00,   !- Time 4 {hh:mm}
	0.55,     !- Value Until Time 4
	13:00,   !- Time 5 {hh:mm}
	0.29,     !- Value Until Time 5
	16:00,   !- Time 6 {hh:mm}
	0.55,     !- Value Until Time 6
	17:00,   !- Time 7 {hh:mm}
	0.29,     !- Value Until Time 7
	18:00,   !- Time 8 {hh:mm}
	0.15,     !- Value Until Time 8
	21:00,   !- Time 9 {hh:mm}
	0.06,     !- Value Until Time 9
	24:00,   !- Time 10 {hh:mm}
	0.05;     !- Value Until Time 10""", """Schedule:Week:Daily,
	ClassroomEquip Week Schedule, !- Name
	ClassroomEquip Day Schedule - Sun,  !- Sunday Schedule:Day Name
	ClassroomEquip Day Schedule - Mon,  !- Monday Schedule:Day Name
	ClassroomEquip Day Schedule - Mon,  !- Tuesday Schedule:Day Name
	ClassroomEquip Day Schedule - Mon,  !- Wednesday Schedule:Day Name
	ClassroomEquip Day Schedule - Mon,  !- Thursday Schedule:Day Name
	ClassroomEquip Day Schedule - Mon,  !- Friday Schedule:Day Name
	ClassroomEquip Day Schedule - Sun,  !- Saturday Schedule:Day Name
	ClassroomEquip Day Schedule - Sun,  !- Holiday Schedule:Day Name
	ClassroomEquip Day Schedule - Mon,  !- SummerDesignDay Schedule:Day Name
	ClassroomEquip Day Schedule - Sun,  !- WinterDesignDay Schedule:Day Name
	ClassroomEquip Day Schedule - Sun,  !- CustomDay1 Schedule:Day Name
	ClassroomEquip Day Schedule - Sun;  !- CustomDay2 Schedule:Day Name""", """Schedule:Year,
	ClassroomEquip Year Schedule, !- Name
	Fractional, !- Schedule Type Limits Name
	ClassroomEquip Week Schedule,  !- Schedule:Week Name
	1,  !- Start Month 1
	1,  !- Start Day 1
	12,  !- End Month
	31;  !- End Day"""])
classroom_light = Data(["""Schedule:Day:Interval,
	ClassroomLight Day Schedule - Sun, !- Name
	Fractional, !- Schedule Type Limits Name
	No,        !- Interpolate to Timestep
	24:00,   !- Time 1 {hh:mm}
	0.0;     !- Value Until Time 1""", """Schedule:Day:Interval,
	ClassroomLight Day Schedule - Mon, !- Name
	Fractional, !- Schedule Type Limits Name
	No,        !- Interpolate to Timestep
	8:00,   !- Time 1 {hh:mm}
	0.0,     !- Value Until Time 1
	9:00,   !- Time 2 {hh:mm}
	0.1,     !- Value Until Time 2
	10:00,   !- Time 3 {hh:mm}
	0.5,     !- Value Until Time 3
	12:00,   !- Time 4 {hh:mm}
	0.75,     !- Value Until Time 4
	13:00,   !- Time 5 {hh:mm}
	0.5,     !- Value Until Time 5
	16:00,   !- Time 6 {hh:mm}
	0.75,     !- Value Until Time 6
	17:00,   !- Time 7 {hh:mm}
	0.5,     !- Value Until Time 7
	18:00,   !- Time 8 {hh:mm}
	0.25,     !- Value Until Time 8
	21:00,   !- Time 9 {hh:mm}
	0.1,     !- Value Until Time 9
	24:00,   !- Time 10 {hh:mm}
	0.0;     !- Value Until Time 10""", """Schedule:Week:Daily,
	ClassroomLight Week Schedule, !- Name
	ClassroomLight Day Schedule - Sun,  !- Sunday Schedule:Day Name
	ClassroomLight Day Schedule - Mon,  !- Monday Schedule:Day Name
	ClassroomLight Day Schedule - Mon,  !- Tuesday Schedule:Day Name
	ClassroomLight Day Schedule - Mon,  !- Wednesday Schedule:Day Name
	ClassroomLight Day Schedule - Mon,  !- Thursday Schedule:Day Name
	ClassroomLight Day Schedule - Mon,  !- Friday Schedule:Day Name
	ClassroomLight Day Schedule - Sun,  !- Saturday Schedule:Day Name
	ClassroomLight Day Schedule - Sun,  !- Holiday Schedule:Day Name
	ClassroomLight Day Schedule - Mon,  !- SummerDesignDay Schedule:Day Name
	ClassroomLight Day Schedule - Sun,  !- WinterDesignDay Schedule:Day Name
	ClassroomLight Day Schedule - Sun,  !- CustomDay1 Schedule:Day Name
	ClassroomLight Day Schedule - Sun;  !- CustomDay2 Schedule:Day Name""", """Schedule:Year,
	ClassroomLight Year Schedule, !- Name
	Fractional, !- Schedule Type Limits Name
	ClassroomLight Week Schedule,  !- Schedule:Week Name
	1,  !- Start Month 1
	1,  !- Start Day 1
	12,  !- End Month
	31;  !- End Day"""])
labs21lights = Data(["""Schedule:Day:Interval,
	Labs21Lights Day Schedule - Sun, !- Name
	Fractional, !- Schedule Type Limits Name
	No,        !- Interpolate to Timestep
	8:00,   !- Time 1 {hh:mm}
	0.1,     !- Value Until Time 1
	12:00,   !- Time 2 {hh:mm}
	0.4,     !- Value Until Time 2
	17:00,   !- Time 3 {hh:mm}
	0.2,     !- Value Until Time 3
	24:00,   !- Time 4 {hh:mm}
	0.1;     !- Value Until Time 4""", """Schedule:Day:Interval,
	Labs21Lights Day Schedule - Mon, !- Name
	Fractional, !- Schedule Type Limits Name
	No,        !- Interpolate to Timestep
	6:00,   !- Time 1 {hh:mm}
	0.2,     !- Value Until Time 1
	7:00,   !- Time 2 {hh:mm}
	0.3,     !- Value Until Time 2
	8:00,   !- Time 3 {hh:mm}
	0.5,     !- Value Until Time 3
	12:00,   !- Time 4 {hh:mm}
	0.9,     !- Value Until Time 4
	13:00,   !- Time 5 {hh:mm}
	0.8,     !- Value Until Time 5
	18:00,   !- Time 6 {hh:mm}
	0.9,     !- Value Until Time 6
	20:00,   !- Time 7 {hh:mm}
	0.5,     !- Value Until Time 7
	22:00,   !- Time 8 {hh:mm}
	0.3,     !- Value Until Time 8
	24:00,   !- Time 9 {hh:mm}
	0.2;     !- Value Until Time 9""", """Schedule:Day:Interval,
	Labs21Lights Day Schedule - HDD, !- Name
	Fractional, !- Schedule Type Limits Name
	No,        !- Interpolate to Timestep
	24:00,   !- Time 1 {hh:mm}
	0.0;     !- Value Until Time 1""", """Schedule:Week:Daily,
	Labs21Lights Week Schedule, !- Name
	Labs21Lights Day Schedule - Sun,  !- Sunday Schedule:Day Name
	Labs21Lights Day Schedule - Mon,  !- Monday Schedule:Day Name
	Labs21Lights Day Schedule - Mon,  !- Tuesday Schedule:Day Name
	Labs21Lights Day Schedule - Mon,  !- Wednesday Schedule:Day Name
	Labs21Lights Day Schedule - Mon,  !- Thursday Schedule:Day Name
	Labs21Lights Day Schedule - Mon,  !- Friday Schedule:Day Name
	Labs21Lights Day Schedule - Sun,  !- Saturday Schedule:Day Name
	Labs21Lights Day Schedule - Sun,  !- Holiday Schedule:Day Name
	Labs21Lights Day Schedule - Mon,  !- SummerDesignDay Schedule:Day Name
	Labs21Lights Day Schedule - HDD,  !- WinterDesignDay Schedule:Day Name
	Labs21Lights Day Schedule - Sun,  !- CustomDay1 Schedule:Day Name
	Labs21Lights Day Schedule - Sun;  !- CustomDay2 Schedule:Day Name""", """Schedule:Year,
	Labs21Lights Year Schedule, !- Name
	Fractional, !- Schedule Type Limits Name
	Labs21Lights Week Schedule,  !- Schedule:Week Name
	1,  !- Start Month 1
	1,  !- Start Day 1
	12,  !- End Month
	31;  !- End Day"""])
heatingsetpt = Data(["""Schedule:Day:Interval,
	AcaOfficeHeatSetPt Day Schedule - Sun, !- Name
	Temperature 1, !- Schedule Type Limits Name
	No,        !- Interpolate to Timestep
	24:00,   !- Time 1 {hh:mm}
	18.3333333333;     !- Value Until Time 1""", """Schedule:Day:Interval,
	AcaOfficeHeatSetPt Day Schedule - Mon, !- Name
	Temperature 1, !- Schedule Type Limits Name
	No,        !- Interpolate to Timestep
	6:00,   !- Time 1 {hh:mm}
	18.3333333333,     !- Value Until Time 1
	18:00,   !- Time 2 {hh:mm}
	21.1111111111,     !- Value Until Time 2
	24:00,   !- Time 3 {hh:mm}
	18.3333333333;     !- Value Until Time 3""", """Schedule:Week:Daily,
	AcaOfficeHeatSetPt Week Schedule, !- Name
	AcaOfficeHeatSetPt Day Schedule - Sun,  !- Sunday Schedule:Day Name
	AcaOfficeHeatSetPt Day Schedule - Mon,  !- Monday Schedule:Day Name
	AcaOfficeHeatSetPt Day Schedule - Mon,  !- Tuesday Schedule:Day Name
	AcaOfficeHeatSetPt Day Schedule - Mon,  !- Wednesday Schedule:Day Name
	AcaOfficeHeatSetPt Day Schedule - Mon,  !- Thursday Schedule:Day Name
	AcaOfficeHeatSetPt Day Schedule - Mon,  !- Friday Schedule:Day Name
	AcaOfficeHeatSetPt Day Schedule - Sun,  !- Saturday Schedule:Day Name
	AcaOfficeHeatSetPt Day Schedule - Sun,  !- Holiday Schedule:Day Name
	AcaOfficeHeatSetPt Day Schedule - Mon,  !- SummerDesignDay Schedule:Day Name
	AcaOfficeHeatSetPt Day Schedule - Sun,  !- WinterDesignDay Schedule:Day Name
	AcaOfficeHeatSetPt Day Schedule - Sun,  !- CustomDay1 Schedule:Day Name
	AcaOfficeHeatSetPt Day Schedule - Sun;  !- CustomDay2 Schedule:Day Name""", """Schedule:Year,
	AcaOfficeHeatSetPt Year Schedule, !- Name
	Temperature 1, !- Schedule Type Limits Name
	AcaOfficeHeatSetPt Week Schedule,  !- Schedule:Week Name
	1,  !- Start Month 1
	1,  !- Start Day 1
	12,  !- End Month
	31;  !- End Day"""])
coolingsetpt = Data(["""Schedule:Day:Interval,
	AcaOfficeCoolSetPt Day Schedule - Sun, !- Name
	Temperature 1, !- Schedule Type Limits Name
	No,        !- Interpolate to Timestep
	24:00,   !- Time 1 {hh:mm}
	27.2222222222;     !- Value Until Time 1""", """Schedule:Day:Interval,
	AcaOfficeCoolSetPt Day Schedule - Mon, !- Name
	Temperature 1, !- Schedule Type Limits Name
	No,        !- Interpolate to Timestep
	6:00,   !- Time 1 {hh:mm}
	26.6666666667,     !- Value Until Time 1
	18:00,   !- Time 2 {hh:mm}
	23.8888888889,     !- Value Until Time 2
	24:00,   !- Time 3 {hh:mm}
	26.6666666667;     !- Value Until Time 3""", """Schedule:Week:Daily,
	AcaOfficeCoolSetPt Week Schedule, !- Name
	AcaOfficeCoolSetPt Day Schedule - Sun,  !- Sunday Schedule:Day Name
	AcaOfficeCoolSetPt Day Schedule - Mon,  !- Monday Schedule:Day Name
	AcaOfficeCoolSetPt Day Schedule - Mon,  !- Tuesday Schedule:Day Name
	AcaOfficeCoolSetPt Day Schedule - Mon,  !- Wednesday Schedule:Day Name
	AcaOfficeCoolSetPt Day Schedule - Mon,  !- Thursday Schedule:Day Name
	AcaOfficeCoolSetPt Day Schedule - Mon,  !- Friday Schedule:Day Name
	AcaOfficeCoolSetPt Day Schedule - Sun,  !- Saturday Schedule:Day Name
	AcaOfficeCoolSetPt Day Schedule - Sun,  !- Holiday Schedule:Day Name
	AcaOfficeCoolSetPt Day Schedule - Mon,  !- SummerDesignDay Schedule:Day Name
	AcaOfficeCoolSetPt Day Schedule - Sun,  !- WinterDesignDay Schedule:Day Name
	AcaOfficeCoolSetPt Day Schedule - Sun,  !- CustomDay1 Schedule:Day Name
	AcaOfficeCoolSetPt Day Schedule - Sun;  !- CustomDay2 Schedule:Day Name""", """Schedule:Year,
	AcaOfficeCoolSetPt Year Schedule, !- Name
	Temperature 1, !- Schedule Type Limits Name
	AcaOfficeCoolSetPt Week Schedule,  !- Schedule:Week Name
	1,  !- Start Month 1
	1,  !- Start Day 1
	12,  !- End Month
	31;  !- End Day"""])
labs21equip = Data(["""Schedule:Day:Interval,
	Labs21Equip Day Schedule - Sun, !- Name
	Fractional, !- Schedule Type Limits Name
	No,        !- Interpolate to Timestep
	6:00,   !- Time 1 {hh:mm}
	0.2,     !- Value Until Time 1
	8:00,   !- Time 2 {hh:mm}
	0.3,     !- Value Until Time 2
	12:00,   !- Time 3 {hh:mm}
	0.4,     !- Value Until Time 3
	17:00,   !- Time 4 {hh:mm}
	0.3,     !- Value Until Time 4
	24:00,   !- Time 5 {hh:mm}
	0.2;     !- Value Until Time 5""", """Schedule:Day:Interval,
	Labs21Equip Day Schedule - Mon, !- Name
	Fractional, !- Schedule Type Limits Name
	No,        !- Interpolate to Timestep
	7:00,   !- Time 1 {hh:mm}
	0.2,     !- Value Until Time 1
	8:00,   !- Time 2 {hh:mm}
	0.3,     !- Value Until Time 2
	9:00,   !- Time 3 {hh:mm}
	0.4,     !- Value Until Time 3
	12:00,   !- Time 4 {hh:mm}
	0.5,     !- Value Until Time 4
	13:00,   !- Time 5 {hh:mm}
	0.4,     !- Value Until Time 5
	17:00,   !- Time 6 {hh:mm}
	0.5,     !- Value Until Time 6
	18:00,   !- Time 7 {hh:mm}
	0.4,     !- Value Until Time 7
	20:00,   !- Time 8 {hh:mm}
	0.3,     !- Value Until Time 8
	24:00,   !- Time 9 {hh:mm}
	0.2;     !- Value Until Time 9""", """Schedule:Day:Interval,
	Labs21Equip Day Schedule - CDD, !- Name
	Fractional, !- Schedule Type Limits Name
	No,        !- Interpolate to Timestep
	24:00,   !- Time 1 {hh:mm}
	1.0;     !- Value Until Time 1""", """Schedule:Day:Interval,
	Labs21Equip Day Schedule - HDD, !- Name
	Fractional, !- Schedule Type Limits Name
	No,        !- Interpolate to Timestep
	24:00,   !- Time 1 {hh:mm}
	0.0;     !- Value Until Time 1""", """Schedule:Week:Daily,
	Labs21Equip Week Schedule, !- Name
	Labs21Equip Day Schedule - Sun,  !- Sunday Schedule:Day Name
	Labs21Equip Day Schedule - Mon,  !- Monday Schedule:Day Name
	Labs21Equip Day Schedule - Mon,  !- Tuesday Schedule:Day Name
	Labs21Equip Day Schedule - Mon,  !- Wednesday Schedule:Day Name
	Labs21Equip Day Schedule - Mon,  !- Thursday Schedule:Day Name
	Labs21Equip Day Schedule - Mon,  !- Friday Schedule:Day Name
	Labs21Equip Day Schedule - Sun,  !- Saturday Schedule:Day Name
	Labs21Equip Day Schedule - Sun,  !- Holiday Schedule:Day Name
	Labs21Equip Day Schedule - CDD,  !- SummerDesignDay Schedule:Day Name
	Labs21Equip Day Schedule - HDD,  !- WinterDesignDay Schedule:Day Name
	Labs21Equip Day Schedule - Sun,  !- CustomDay1 Schedule:Day Name
	Labs21Equip Day Schedule - Sun;  !- CustomDay2 Schedule:Day Name""", """Schedule:Year,
	Labs21Equip Year Schedule, !- Name
	Fractional, !- Schedule Type Limits Name
	Labs21Equip Week Schedule,  !- Schedule:Week Name
	1,  !- Start Month 1
	1,  !- Start Day 1
	12,  !- End Month
	31;  !- End Day"""])
occupancy = Data(["""Schedule:Day:Interval,
	AcaOfficeOcc Day Schedule - Sun, !- Name
	Fractional, !- Schedule Type Limits Name
	No,        !- Interpolate to Timestep
	24:00,   !- Time 1 {hh:mm}
	0.0;     !- Value Until Time 1""", """Schedule:Day:Interval,
	AcaOfficeOcc Day Schedule - Mon, !- Name
	Fractional, !- Schedule Type Limits Name
	No,        !- Interpolate to Timestep
	6:00,   !- Time 1 {hh:mm}
	0.0,     !- Value Until Time 1
	7:00,   !- Time 2 {hh:mm}
	0.2,     !- Value Until Time 2
	8:00,   !- Time 3 {hh:mm}
	0.25,     !- Value Until Time 3
	9:00,   !- Time 4 {hh:mm}
	0.9,     !- Value Until Time 4
	12:00,   !- Time 5 {hh:mm}
	0.95,     !- Value Until Time 5
	13:00,   !- Time 6 {hh:mm}
	0.15,     !- Value Until Time 6
	16:00,   !- Time 7 {hh:mm}
	0.95,     !- Value Until Time 7
	17:00,   !- Time 8 {hh:mm}
	0.9,     !- Value Until Time 8
	18:00,   !- Time 9 {hh:mm}
	0.1,     !- Value Until Time 9
	24:00,   !- Time 10 {hh:mm}
	0.0;     !- Value Until Time 10""", """Schedule:Week:Daily,
	AcaOfficeOcc Week Schedule, !- Name
	AcaOfficeOcc Day Schedule - Sun,  !- Sunday Schedule:Day Name
	AcaOfficeOcc Day Schedule - Mon,  !- Monday Schedule:Day Name
	AcaOfficeOcc Day Schedule - Mon,  !- Tuesday Schedule:Day Name
	AcaOfficeOcc Day Schedule - Mon,  !- Wednesday Schedule:Day Name
	AcaOfficeOcc Day Schedule - Mon,  !- Thursday Schedule:Day Name
	AcaOfficeOcc Day Schedule - Mon,  !- Friday Schedule:Day Name
	AcaOfficeOcc Day Schedule - Sun,  !- Saturday Schedule:Day Name
	AcaOfficeOcc Day Schedule - Sun,  !- Holiday Schedule:Day Name
	AcaOfficeOcc Day Schedule - Mon,  !- SummerDesignDay Schedule:Day Name
	AcaOfficeOcc Day Schedule - Sun,  !- WinterDesignDay Schedule:Day Name
	AcaOfficeOcc Day Schedule - Sun,  !- CustomDay1 Schedule:Day Name
	AcaOfficeOcc Day Schedule - Sun;  !- CustomDay2 Schedule:Day Name""", """Schedule:Year,
	AcaOfficeOcc Year Schedule, !- Name
	Fractional, !- Schedule Type Limits Name
	AcaOfficeOcc Week Schedule,  !- Schedule:Week Name
	1,  !- Start Month 1
	1,  !- Start Day 1
	12,  !- End Month
	31;  !- End Day"""])
equipment = Data(["""Schedule:Day:Interval,
	AcaOfficeEquip Day Schedule - Sun, !- Name
	Fractional, !- Schedule Type Limits Name
	No,        !- Interpolate to Timestep
	24:00,   !- Time 1 {hh:mm}
	0.0;     !- Value Until Time 1""", """Schedule:Day:Interval,
	AcaOfficeEquip Day Schedule - Mon, !- Name
	Fractional, !- Schedule Type Limits Name
	No,        !- Interpolate to Timestep
	6:00,   !- Time 1 {hh:mm}
	0.05,     !- Value Until Time 1
	7:00,   !- Time 2 {hh:mm}
	0.2,     !- Value Until Time 2
	8:00,   !- Time 3 {hh:mm}
	0.25,     !- Value Until Time 3
	9:00,   !- Time 4 {hh:mm}
	0.9,     !- Value Until Time 4
	12:00,   !- Time 5 {hh:mm}
	0.95,     !- Value Until Time 5
	13:00,   !- Time 6 {hh:mm}
	0.15,     !- Value Until Time 6
	16:00,   !- Time 7 {hh:mm}
	0.95,     !- Value Until Time 7
	17:00,   !- Time 8 {hh:mm}
	0.9,     !- Value Until Time 8
	18:00,   !- Time 9 {hh:mm}
	0.1,     !- Value Until Time 9
	24:00,   !- Time 10 {hh:mm}
	0.05;     !- Value Until Time 10""", """Schedule:Week:Daily,
	AcaOfficeEquip Week Schedule, !- Name
	AcaOfficeEquip Day Schedule - Sun,  !- Sunday Schedule:Day Name
	AcaOfficeEquip Day Schedule - Mon,  !- Monday Schedule:Day Name
	AcaOfficeEquip Day Schedule - Mon,  !- Tuesday Schedule:Day Name
	AcaOfficeEquip Day Schedule - Mon,  !- Wednesday Schedule:Day Name
	AcaOfficeEquip Day Schedule - Mon,  !- Thursday Schedule:Day Name
	AcaOfficeEquip Day Schedule - Mon,  !- Friday Schedule:Day Name
	AcaOfficeEquip Day Schedule - Sun,  !- Saturday Schedule:Day Name
	AcaOfficeEquip Day Schedule - Sun,  !- Holiday Schedule:Day Name
	AcaOfficeEquip Day Schedule - Mon,  !- SummerDesignDay Schedule:Day Name
	AcaOfficeEquip Day Schedule - Sun,  !- WinterDesignDay Schedule:Day Name
	AcaOfficeEquip Day Schedule - Sun,  !- CustomDay1 Schedule:Day Name
	AcaOfficeEquip Day Schedule - Sun;  !- CustomDay2 Schedule:Day Name""", """Schedule:Year,
	AcaOfficeEquip Year Schedule, !- Name
	Fractional, !- Schedule Type Limits Name
	AcaOfficeEquip Week Schedule,  !- Schedule:Week Name
	1,  !- Start Month 1
	1,  !- Start Day 1
	12,  !- End Month
	31;  !- End Day"""])
addtoeplibrary = Honeybee_AddToEnergyPlusLibrary(
    EPObject=[heatingsetpt, coolingsetpt, labs21occupancy, labs21lights, labs21equip, labs21ventilation, occupancy, equipment, classroom_light, classroom_equip, classroom_occupancy],
    addToProjectLib=toggle_2,
    overwrite=toggle_2)  # -> readMe; plug-in component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

# ----
# Find Interior Surfaces
# + Generate Windows
solveadjc = Honeybee_SolveAdjacencies(HBZones=flatten(all_zones_2), removeCurrentAdjc=False, findAdjc=Toggle(True))  # -> readMe, HBZonesWADJ; plug-in component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
glazingcreator_2 = Honeybee_GlazingBasedOnRatio(HBObjects=solveadjc.HBZonesWADJ, glzRatio="0.65", sillHeight="0.75", runIt=Toggle(True))  # -> readMe, HBObjWGLZ; plug-in component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

construction_name = Panel("Baseline Triple Pane")
u_value_btu_h_ft2_f = Panel("0.25")
shgc = Panel("0.35")
uip2usi = Ladybug_uIP2uSI(U_IP=u_value_btu_h_ft2_f)  # -> U_SI; plug-in component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
vt = Panel("0.55")
epwindowmat = Honeybee_EnergyPlusWindowMaterial(name=construction_name, U_Value=uip2usi, SHGC=shgc, VT=vt)  # -> EPMaterial; plug-in component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
epconstruction = Honeybee_EnergyPlusConstruction(name=construction_name, layer_1=epwindowmat)  # -> EPConstruction; plug-in component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

r_value_h_ft2_f_btu = Panel("30")
construction_name_2 = Panel("Baseline Floor")
rip2rsi = Ladybug_rIP2rSI(R_IP=r_value_h_ft2_f_btu)  # -> R_SI; plug-in component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
epnomassmat = Honeybee_EnergyPlusNoMassOpaqueMaterial(name=construction_name_2, R_Value=rip2rsi)  # -> EPMaterial; plug-in component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
epconstruction_2 = Honeybee_EnergyPlusConstruction(name=construction_name_2, layer_1=epnomassmat)  # -> EPConstruction; plug-in component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

r_value_h_ft2_f_btu_2 = Panel("20")
construction_name_3 = Panel("Baseline Wall")
rip2rsi_2 = Ladybug_rIP2rSI(R_IP=r_value_h_ft2_f_btu_2)  # -> R_SI; plug-in component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
epnomassmat_2 = Honeybee_EnergyPlusNoMassOpaqueMaterial(name=construction_name_3, R_Value=rip2rsi_2)  # -> EPMaterial; plug-in component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
epconstruction_3 = Honeybee_EnergyPlusConstruction(name=construction_name_3, layer_1=epnomassmat_2)  # -> EPConstruction; plug-in component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

r_value_h_ft2_f_btu_3 = Panel("40")
construction_name_4 = Panel("Baseline Roof")
rip2rsi_3 = Ladybug_rIP2rSI(R_IP=r_value_h_ft2_f_btu_3)  # -> R_SI; plug-in component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
epnomassmat_3 = Honeybee_EnergyPlusNoMassOpaqueMaterial(name=construction_name_4, R_Value=rip2rsi_3)  # -> EPMaterial; plug-in component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
epconstruction_4 = Honeybee_EnergyPlusConstruction(name=construction_name_4, layer_1=epnomassmat_3)  # -> EPConstruction; plug-in component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

# ----
# Assign Constructions + Shading
setepzonecnstr = Honeybee_SetEPZoneConstruction(
    HBZones=flatten(glazingcreator_2.HBObjWGLZ),
    wallEPConstruction=epconstruction_3,
    windowEPConstruction=epconstruction,
    roofEPConstruction=epconstruction_4,
    expFloorEPConstruction=epconstruction_2)  # -> simplify(modifiedHBZones); plug-in component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

# ----
# Assign HVAC Systems
panel_9 = Panel("2737")
hvacsystemslist = Honeybee_HVACSystemsList({"-1. Thermostat Only": -1, "0. Ideal Air Loads": 0, "1. PTAC | Residential": 1, "2. PTHP | Residential": 2, "3. Packaged Single Zone - AC": 3, "4. Packaged Single Zone - HP": 4, "5. Packaged VAV w/ Reheat": 5, "6. Packaged VAV w/ PFP Boxes": 6, "7. VAV w/ Reheat": 7, "8. VAV w/ PFP Boxes": 8, "9. Warm Air Furnace - Gas Fired": 9, "10.Warm Air Furnace - Electric": 10, "11.Fan Coil Units + DOAS": 11, "12.Active Chilled Beams + DOAS": 12, "13.Radiant Floors + DOAS": 13, "14.Radiant Ceilings + DOAS": 14, "15.Heated Floors + VAV Cooling": 15, "16.VRF + DOAS": 16, "17.Ground Source WSHP + DOAS": 17, "18.Ground Source VRF + DOAS": 18}, selected="11.Fan Coil Units + DOAS")
geo_2 = Geometry(flatten(setepzonecnstr))
airdetails = Honeybee_HVACAirDetails(fanPressureRise=panel_9, sensibleHeatRecovery="0.5")  # -> airDetails; plug-in component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
hvacsystem = Honeybee_AssignHVACSystem(HBZones=flatten(geo_2), HVACSystems=hvacsystemslist, airDetails=airdetails)  # -> readMe, HBZones; plug-in component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

# ----
# Simulation Parameters
panel_10 = Panel("https://www.energyplus.net/weather-download/north_and_central_america_wmo_region_4/USA/MA/USA_MA_Boston-Logan.Intl.AP.725090_TMY3/all")
epoutput = Honeybee_GenerateEPOutput(
    zoneEnergyUse=Toggle(True),
    zoneGainsAndLosses="False",
    zoneComfortMetrics="False",
    surfaceTempAnalysis="False",
    timestep="annual")  # -> report, flatten(simulationOutputs); plug-in component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
energysimpar = Honeybee_EnergySimulationPar(timestep=6, solarDistribution="1")  # -> energySimPar; plug-in component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
epw_stat = Ladybug_OpenEPWAndSTATWeatherFiles(weatherFileURL=panel_10)  # -> epwFile, statFile; plug-in component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

# ----
# Context Shade
geo_3 = Geometry([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])
hb_epcontextsrf = HoneybeeEPContextSurfaces(shdSurfaces=flatten(geo_3))  # -> HBContext; inputs shdSurfaces: list of Brep, justBoundingBox: Boolean
# ---------- hb_epcontextsrf: Python ----------
"""
prepare shading/context geometries

    Args:
        northVectorOrRotation: A vector that shows North or a number that shows
                               the rotation of the North from the Y axis
        bldgMasses: List of closed Breps as thermal zones.
    Returns:
        report: ...
        thermalZones: Thermal zone's geometries for visualiza
"""

ghenv.Component.Name = 'Honeybee EP context Surfaces'
ghenv.Component.NickName = 'HB_EPContextSrf'
ghenv.Component.Message = 'VER 0.0.64\nNOV_20_2018'
ghenv.Component.IconDisplayMode = ghenv.Component.IconDisplayMode.application
ghenv.Component.Category = "Honeybee"
ghenv.Component.SubCategory = "10 | Energy | Energy"
#compatibleHBVersion = VER 0.0.57\nNOV_04_2016
#compatibleLBVersion = VER 0.0.59\nFEB_01_2015
ghenv.Component.AdditionalHelpFromDocStrings = "2"

import rhinoscriptsyntax as rs
import Rhino as rc
import scriptcontext as sc
import os
import System
import Grasshopper.Kernel as gh
import uuid

tolerance = sc.doc.ModelAbsoluteTolerance
import math


def main(shdSurfaces, EPTransSchedule, meshingSettings, justBoundingBox):
    
    # import the classes
    if sc.sticky.has_key('honeybee_release'):

        try:
            if not sc.sticky['honeybee_release'].isCompatible(ghenv.Component): return -1
            if sc.sticky['honeybee_release'].isInputMissing(ghenv.Component): return -1
        except:
            warning = "You need a newer version of Honeybee to use this compoent." + \
            " Use updateHoneybee component to update userObjects.\n" + \
            "If you have already updated userObjects drag Honeybee_Honeybee component " + \
            "into canvas and try again."
            w = gh.GH_RuntimeMessageLevel.Warning
            ghenv.Component.AddRuntimeMessage(w, warning)
            return -1
        
        # don't customize this part
        hb_EPSrf = sc.sticky["honeybee_EPSurface"]
        hb_EPSHDSurface = sc.sticky["honeybee_EPShdSurface"]
        hb_RADMaterialAUX = sc.sticky["honeybee_RADMaterialAUX"]
        hb_EPObjectsAux = sc.sticky["honeybee_EPObjectsAUX"]()
        HBScheduleList = sc.sticky["honeybee_ScheduleLib"].keys()

        ########################################################################
        #----------------------------------------------------------------------#
        shdBreps = []
        # create bounding box of shading geometries
        if justBoundingBox:
            for brep in shdSurfaces:
                if brep.Faces.Count>1 or not brep.Faces[0].IsPlanar(sc.doc.ModelAbsoluteTolerance):
                    shdBreps.append(brep.GetBoundingBox(True).ToBrep())
                else:
                    shdBreps.append(brep)
        else:
            shdBreps = shdSurfaces
        
        shadingClasses = []
        shadingMeshPreview = []
        
        if meshingSettings == None:
            mp = rc.Geometry.MeshingParameters.Minimal
            mp.SimplePlanes = True
        else:
            mp = meshingSettings
        
        def getRadMaterialName(radMaterial):
            nameStr = radMaterial.split(" ")[2]
            name =  nameStr.split("\n")[0]
            return name
        
        for brepCount, brep in enumerate(shdBreps):
            if brep != None:
                isPlanar = True
                # check planarity
                for face in brep.Faces:
                    if not face.IsPlanar(tolerance):
                        isPlanar = False
                        break
                
                shadingBreps = []
                if not isPlanar:
                    meshArray = rc.Geometry.Mesh.CreateFromBrep(brep, mp)
                    for mesh in meshArray:
                        for meshFace in range(mesh.Faces.Count):
                            vertices = list(mesh.Faces.GetFaceVertices(meshFace))[1:]
                            vertices = vertices + [sc.doc.ModelAbsoluteTolerance]
                            # create the brep from mesh
                            shdBrep = rc.Geometry.Brep.CreateFromCornerPoints(*vertices)
                            shadingBreps.append(shdBrep)
                else:
                    for face in brep.Faces:
                        shadingBreps.append(face.DuplicateFace(False))
                
                for faceCount, shdBrep in enumerate(shadingBreps):
                        thisShading = hb_EPSHDSurface(shdBrep, 1000*brepCount + faceCount, 'shdSrf_' + `brepCount` + '_' + `faceCount` + "_" + str(uuid.uuid4()))
                        
                        # add transmittance schedule if any
                        if EPTransSchedule!=None:
                            schedule= EPTransSchedule.upper()
                            if schedule!=None and not schedule.lower().endswith(".csv") and schedule not in HBScheduleList:
                                msg = "Cannot find " + schedule + " in Honeybee schedule library."
                                print msg
                                ghenv.Component.AddRuntimeMessage(gh.GH_RuntimeMessageLevel.Warning, msg)
                                return -1
                            elif schedule!=None and schedule.lower().endswith(".csv"):
                                # check if csv file is existed
                                if not os.path.isfile(schedule):
                                    msg = "Cannot find the shchedule file: " + schedule
                                    print msg
                                    ghenv.Component.AddRuntimeMessage(gh.GH_RuntimeMessageLevel.Warning, msg)
                                    return -1
                            
                            thisShading.TransmittanceSCH = schedule
                        
                        # add the Rad Material if any
                        if RADMaterial!=None:
                            # if it is just the name of the material make sure it is already defined
                            if len(RADMaterial.split(" ")) == 1:
                                # if the material is not in the library add it to the library
                                if not hb_RADMaterialAUX.isMatrialExistInLibrary(RADMaterial):
                                    warningMsg = "Can't find " + RADMaterial + " in RAD Material Library.\n" + \
                                                "Add the material to the library and try again."
                                    ghenv.Component.AddRuntimeMessage(gh.GH_RuntimeMessageLevel.Warning, warningMsg)
                                    return
                                
                                try:
                                    thisShading.setRADMaterial(RADMaterial)
                                except Exception, e:
                                    print e
                                    warningMsg = "You are using an old version of Honeybee_Honeybee! Update your files and try again."
                                    print warningMsg
                                    ghenv.Component.AddRuntimeMessage(gh.GH_RuntimeMessageLevel.Warning, warningMsg)
                                    return
                                
                                addedToLib = True
                            else:
                                
                                # try to add the material to the library
                                addedToLib, thisShading.RadMaterial = hb_RADMaterialAUX.analyseRadMaterials(RADMaterial, True)
                                
                            if addedToLib==False:
                                warningMsg = "Failed to add " + RADMaterial + " to the Library."
                                ghenv.Component.AddRuntimeMessage(gh.GH_RuntimeMessageLevel.Warning, warningMsg)
                                return
                        
                        # add shading to the list
                        shadingClasses.append(thisShading)
                
        # add to the hive
        hb_hive = sc.sticky["honeybee_Hive"]()
        HBContext  = hb_hive.addToHoneybeeHive(shadingClasses, ghenv.Component)
        return HBContext
        ################################################################################################
    else:
        print "You should first let Honeybee to fly..."
        w = gh.GH_RuntimeMessageLevel.Warning
        ghenv.Component.AddRuntimeMessage(w, "You should first let Honeybee to fly...")
        return -1
        

if _shdSurfaces and _shdSurfaces[0]!=None:
    # add cleaning function
    result= main(_shdSurfaces, EPTransSchedule_, meshingSettings_, justBoundingBox_)
    
    if result != -1: HBContext = result
# ---------- end hb_epcontextsrf ----------

# ----
# Visualize Zone
# Geometry
decomposebytype_3 = Honeybee_DecomposeBasedOnType(HBZone=setepzonecnstr)  # -> walls, interiorWalls, airWalls, windows, interiorWindows, skylights, roofs, ceilings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; plug-in component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
edges = BrepEdges(Brep=[decomposebytype_3.walls, decomposebytype_3.windows, decomposebytype_3.roofs, geo_3, decomposebytype_3.exposedFloors])  # -> Naked, Interior, NonManifold
preview_8 = CustomPreview(Geometry=decomposebytype_3.interiorWalls, Shader=ColourSwatch(SwatchColor=RGBA(255, 255, 255, 47)))
preview_9 = CustomPreview(Geometry=decomposebytype_3.walls, Shader=ColourSwatch(SwatchColor=RGB(191, 184, 126)))
preview_10 = CustomPreview(Geometry=decomposebytype_3.windows, Shader=ColourSwatch(SwatchColor=RGBA(133, 222, 255, 134)))
preview_11 = CustomPreview(Geometry=decomposebytype_3.exposedFloors, Shader=ColourSwatch(SwatchColor=RGB(112, 112, 112)))
preview_12 = CustomPreview(Geometry=[hb_epcontextsrf, decomposebytype_3.roofs], Shader=ColourSwatch(SwatchColor=RGB(224, 224, 224)))
geo_4 = Geometry(edges.Naked)

geo_5 = Geometry(flatten(hvacsystem.HBZones))
# Run Energy
# Model
toggle_3 = BooleanToggle(False)
exporttoopenstudio = Honeybee_ExportToOpenStudio(
    epwWeatherFile=epw_stat.epwFile,
    energySimPar=energysimpar,
    HBZones=flatten(geo_5),
    HBContext=flatten(hb_epcontextsrf),
    simulationOutputs=flatten(epoutput.simulationOutputs),
    writeOSM=toggle_3,
    runSimulation=toggle_3,
    fileName="NahantModel")  # -> readMe, osmFileAddress, idfFileAddress, resultFileAddress, eioFileAddress, rddFileAddress, htmlReport, studyFolder, model; plug-in component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

readeio = Honeybee_ReadHVACSizing(eioFile=exporttoopenstudio.eioFileAddress)  # -> zonePeakLoadObjs, zonePeakLoadVals, zoneSizingObjs, zoneSizingValues, systemSizingObjs, systemSizingVals, componentSizObjs, componentSizVals, coolDesignDayLoad, heatDesignDayLoad; plug-in component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
flip = FlipMatrix(Data=readeio.zoneSizingValues)
ma = MassAddition(Input=flip)  # -> flatten(Result), PartialResults
panel_11 = Panel(ma.Result)

readepresult = Honeybee_ReadEPResult(resultFileAddress=exporttoopenstudio.resultFileAddress)  # -> totalThermalLoad, thermalLoadBalance, cooling, heating, electricLight, electricEquip, fanElectric, pumpElectric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; plug-in component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
flrnorm = Honeybee_NormalizeDataByFloorArea(simData=readepresult.fanElectric, HBZones=flatten(geo_5))  # -> totNormData, zoneNormData; plug-in component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
flrnorm_2 = Honeybee_NormalizeDataByFloorArea(simData=readepresult.cooling, HBZones=flatten(geo_5))  # -> totNormData, zoneNormData; plug-in component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
flrnorm_3 = Honeybee_NormalizeDataByFloorArea(simData=readepresult.heating, HBZones=flatten(geo_5))  # -> totNormData, zoneNormData; plug-in component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
flrnorm_4 = Honeybee_NormalizeDataByFloorArea(simData=readepresult.electricLight, HBZones=flatten(geo_5))  # -> totNormData, zoneNormData; plug-in component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
flrnorm_5 = Honeybee_NormalizeDataByFloorArea(simData=readepresult.electricEquip, HBZones=flatten(geo_5))  # -> totNormData, zoneNormData; plug-in component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
flrnorm_6 = Honeybee_NormalizeDataByFloorArea(simData=readepresult.pumpElectric, HBZones=flatten(geo_5))  # -> totNormData, zoneNormData; plug-in component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
strnum = Ladybug_SeparateData(inputList=flatten(flrnorm_2.totNormData))  # -> numbers, strings; plug-in component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
strnum_2 = Ladybug_SeparateData(inputList=flatten(flrnorm_3.totNormData))  # -> numbers, strings; plug-in component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
strnum_3 = Ladybug_SeparateData(inputList=flatten(flrnorm_4.totNormData))  # -> numbers, strings; plug-in component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
strnum_4 = Ladybug_SeparateData(inputList=flatten(flrnorm_5.totNormData))  # -> numbers, strings; plug-in component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
strnum_5 = Ladybug_SeparateData(inputList=flatten(flrnorm.totNormData))  # -> numbers, strings; plug-in component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
strnum_6 = Ladybug_SeparateData(inputList=flatten(flrnorm_6.totNormData))  # -> numbers, strings; plug-in component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
ma_2 = MassAddition(Input=flatten(strnum.numbers))  # -> Result, PartialResults
ma_3 = MassAddition(Input=flatten(strnum_2.numbers))  # -> Result, PartialResults
ma_4 = MassAddition(Input=flatten(strnum_3.numbers))  # -> Result, PartialResults
ma_5 = MassAddition(Input=flatten(strnum_4.numbers))  # -> Result, PartialResults
ma_6 = MassAddition(Input=flatten(strnum_5.numbers))  # -> Result, PartialResults
ma_7 = MassAddition(Input=flatten(strnum_6.numbers))  # -> Result, PartialResults
wh2btu = Ladybug_Whm2BTUft(Wh_m2=[ma_2.Result, ma_3.Result, ma_4.Result, ma_5.Result, ma_6.Result, ma_7.Result])  # -> BTU_ft2; plug-in component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
eui_breakdown_kbtu_sf = Panel(wh2btu)
ma_8 = MassAddition(Input=eui_breakdown_kbtu_sf)  # -> Result, PartialResults
eui_kbtu_sf = Panel(ma_8.Result)
