# Grasshopper definition Radiation_Analysis_for_Annual.gh (Grasshopper 1.0.7)

panel = Panel("https://www.energyplus.net/weather-download/north_and_central_america_wmo_region_4/USA/TN/USA_TN_Nashville.Intl.AP.723270_TMY3/all")
ladybug = Ladybug_Ladybug()  # -> Vviiiiiiiiiizzz; plug-in component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
panel_2 = Panel(ladybug)
open_weather_file = Ladybug_OpenEPWWeatherFile(open=Toggle(True))  # -> epwFile; plug-in component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
epw_stat = Ladybug_OpenEPWAndSTATWeatherFiles(weatherFileURL=panel)  # -> epwFile, statFile; plug-in component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
panel_3 = Panel(epw_stat.epwFile)
analysisperiod = Ladybug_AnalysisPeriod(
    fromMonth=Slider(1, range=1..12),
    fromDay=Slider(1, range=1..31),
    fromHour=Slider(1, range=1..24),
    toMonth=Slider(12, range=1..12),
    toDay=Slider(31, range=1..31),
    toHour=Slider(24, range=1..24))  # -> readMe, analysisPeriod; plug-in component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
gencumulativeskymtx = Ladybug_GenCumulativeSkyMtx(epwFile=open_weather_file, skyDensity=0, workingDir="C:\ladybug_genSky", useOldRes=Toggle(True), runIt=Toggle(True))  # -> readMe, cumulativeSkyMtx; plug-in component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
number_slider = Slider(4119, range=1..8760)  # disabled
selectskymtx = Ladybug_selectSkyMtx(
    cumulativeSkyMtx=gencumulativeskymtx.cumulativeSkyMtx,
    HOY=number_slider,
    analysisPeriod=analysisperiod.analysisPeriod,
    removeDiffuse=False,
    removeDirect=False)  # -> readMe, selectedSkyMtx; plug-in component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
brep = Brep([<brep referenced from the Rhino model> x156])

number_slider_2 = Slider(4.4, range=0..10)
wires = BrepWireframe(Brep=brep, Density=-1)
ext = ExtendCurve(Curve=wires, Type=0, Start=number_slider_2, End=number_slider_2)
preview = CustomPreview(Geometry=ext, Shader=ColourSwatch(SwatchColor=RGB(0, 0, 0)))

# ---- group: test geometry
brep_2 = Brep([<brep referenced from the Rhino model> x28])

# ----
toggle = BooleanToggle(True)
col = Colour()
legendpar = Ladybug_LegendParameters(lowBound="0", highBound="1300", numSegments="14")  # -> legendPar; plug-in component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
radiationanalysis = Ladybug_RadiationAnalysis(
    geometry=flatten(brep_2),
    context=flatten(brep),
    gridSize="2",
    disFromBase="0.1",
    selectedSkyMtx=flatten(selectskymtx.selectedSkyMtx),
    legendPar=flatten(legendpar),
    parallel=toggle,
    runIt=toggle)  # -> readMe, contextMesh, analysisMesh, testPts, testVec, port, radiationResult, radiationMesh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; plug-in component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
panel_4 = Panel(selectskymtx.selectedSkyMtx)
pt = Point(radiationanalysis.testPts)
mesh = Mesh(radiationanalysis.radiationMesh)
