# Grasshopper definition Ray_tracing.gh (Grasshopper 1.0.7)

# Change the hour...
number_slider = Slider(13, range=8..16)
ladybug = Ladybug_Ladybug()  # -> Vviiiiiiiiiizzz; plug-in component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
constructtime = Ladybug_ConstructTime(hour=number_slider, minutes=Slider(43, range=0..60), seconds=0)  # -> hour; plug-in component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
constructlocation = Ladybug_ConstructLocation(locationName="SOMELOCATION", latitude=Slider(36, range=0..100), longitude=0, timeZone=0, elevation=0)  # -> location; plug-in component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
sunpath = Ladybug_SunPath(
    location=constructlocation,
    hour=constructtime,
    day=21,
    month=12,
    timeStep=1,
    sunPathScale=Slider(0.7, range=0..1),
    dailyOrAnnualSunPath=True)  # -> readMe, sunVectors, sunAltitudes, sunAzimuths, port, sunSpheresMesh, sunPathCrvs, compassCrvs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; plug-in component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

# ---- group: moving vector
rev = Reverse(Vector=sunpath.sunVectors)
dist = Distance(PointA=Point(0, 0, 0), PointB=sunpath.sunPositions)
multiplication = Multiplication(A=rev, B=dist)

# ---- group: generate test points
number_slider_2 = Slider(8, range=0..10)
glzsurface = Surface(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)
dom = ConstructDomain(DomainStart=".05", DomainEnd=".95")
range = Range(Domain=dom, Steps=number_slider_2)
range_2 = Range(Domain=dom, Steps=number_slider_2)
preview = CustomPreview(Geometry=glzsurface, Shader=ColourSwatch(SwatchColor=RGBA(116, 145, 255, 107)))
pt = ConstructPoint(XCoordinate=range, YCoordinate=graft(range_2), ZCoordinate=0)
evalsrf = EvaluateSurface(Surface=reparameterize(glzsurface), Point=flatten(pt))  # -> Point, Normal, Frame
move = Move(Geometry=evalsrf.Point, Motion=multiplication)  # -> Geometry, Transform

# ----
ground = Brep(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)

room = Brep(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)
wires = BrepWireframe(Brep=room, Density=-1)

light_shelf = Brep(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)
preview_2 = CustomPreview(Geometry=light_shelf, Shader=ColourSwatch(SwatchColor=RGBA(255, 82, 0, 107)))

context = Brep(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)
preview_3 = CustomPreview(Geometry=context, Shader=ColourSwatch(SwatchColor=RGBA(255, 255, 255, 107)))

wires_2 = BrepWireframe(Brep=ground, Density=-1)
debrep = DeconstructBrep(Brep=context)  # -> Faces, Edges, Vertices
flip = Flip(Surface=debrep.Faces)  # -> Surface, Result
number_slider_3 = Slider(34, range=0..100)
bouncefromsurface = Ladybug_BounceFromSurface(
    sourceSrfs=flip.Surface,
    gridSizeOrPoints=flatten(Slider(2, range=0..10)),
    sunVectors=graft(sunpath.sunVectors),
    context=flatten(ground),
    numOfBounce=Slider(1, range=0..10),
    lastBounceLen=Slider(1, range=0..1),
    firstBounceLen=Slider(20, range=0..100),
    runIt=Toggle(True))  # -> simplify(rays), bouncePts; plug-in component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
forwardraytracing = Ladybug_ForwardRaytracing(
    startPts=move.Geometry,
    startVectors=graft(sunpath.sunVectors),
    context=flatten([light_shelf, room, context]),
    numOfBounce=Slider(1, range=0..10),
    lastBounceLen=Slider(1, range=0..1))  # -> rays; plug-in component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
preview_4 = CustomPreview(Geometry=bouncefromsurface.rays, Shader=ColourSwatch(SwatchColor=RGBA(255, 255, 0, 107)))
preview_5 = CustomPreview(Geometry=forwardraytracing, Shader=ColourSwatch(SwatchColor=RGBA(255, 111, 0, 107)))
