# Grasshopper definition Shadow_Range_analysis.gh (Grasshopper 1.0.6)

ladybug = Ladybug_Ladybug()  # -> Vviiiiiiiiiizzz; plug-in component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
path = FilePath("D:\Johnx\R_and_D\Radiance\weatherFile\CHN_Hong.Kong.SAR.450070_CityUHK.epw")
test_surface = Brep(<brep referenced from the Rhino model>)
brep = Brep([<brep referenced from the Rhino model> x3])
importepw = Ladybug_ImportEpw(epwFile=path)  # -> readMe, latitude, location, dryBulbTemperature, dewPointTemperature, relativeHumidity, windSpeed, windDirection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; plug-in component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
wires = BrepWireframe(Brep=brep, Density=-1)
preview = CustomPreview(Geometry=brep, Shader=ColourSwatch(SwatchColor=RGB(255, 255, 255)))
preview_2 = CustomPreview(Geometry=test_surface, Shader=ColourSwatch(SwatchColor=RGBA(255, 255, 255, 223)))
# All hours during 21 DEC
panel = Panel("1")
series = Series(Start="9", Step=1, Count=panel)
panel_2 = Panel(series)
sunpath = Ladybug_SunPath(
    location=importepw.location,
    hour=series,
    day="21",
    month="12",
    timeStep=1,
    sunPathScale=Slider(2, range=0..10),
    dailyOrAnnualSunPath=True)  # -> readMe, sunVectors, sunAltitudes, sunAzimuths, port, sunSpheresMesh, sunPathCrvs, compassCrvs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; plug-in component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
# Draw Sun-path
sunpath_2 = Ladybug_SunPath(location=importepw.location, hour=series, day="21", month="12", timeStep=1, dailyOrAnnualSunPath=True)  # -> readMe, sunVectors, sunAltitudes, sunAzimuths, port, sunSpheresMesh, sunPathCrvs, compassCrvs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; plug-in component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

# ---- group: set up number of legend segments based on number of vectors
lng = ListLength(List=sunpath_2.sunVectors)
addition = Addition(A=lng, B=1)
legendpar = Ladybug_LegendParameters(numSegments=addition)  # -> legendPar; plug-in component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

# ----
sunlighthoursanalysis = Ladybug_SunlightHoursAnalysis(
    geometry=flatten(test_surface),
    context=flatten(brep),
    gridSize="0.5",
    disFromBase=Slider(0.001, range=0..0.001),
    sunVectors=flatten(sunpath_2.sunVectors),
    timeStep=1,
    legendPar=flatten(legendpar),
    parallel=Toggle(True),
    runIt=Toggle(True))  # -> readMe, contextMesh, analysisMesh, testPts, testVec, port, sunlightHoursResult, sunlightHoursMesh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; plug-in component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
mesh = Mesh(sunlighthoursanalysis.sunlightHoursMesh)
