# Grasshopper definition Vector-BasedShadow_Study.gh (Grasshopper 1.0.6)

# This component still needs so much work to be fully functional. Here is just a simple example.
panel = Panel("someLocation")
constructlocation = Ladybug_ConstructLocation(locationName=panel, latitude="25", longitude=0, timeZone=0, elevation=0)  # -> location; plug-in component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
open_weather_file = Ladybug_OpenEPWWeatherFile(open=Toggle(True))  # -> epwFile; plug-in component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
sunlighthoursanalysis = Ladybug_SunlightHoursAnalysis(timeStep=1)  # -> readMe, contextMesh, analysisMesh, testPts, testVec, port, sunlightHoursResult, sunlightHoursMesh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; plug-in component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
importepw = Ladybug_ImportEpw(epwFile=open_weather_file)  # -> readMe, latitude, location, dryBulbTemperature, dewPointTemperature, relativeHumidity, windSpeed, windDirection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; plug-in component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
ladybug = Ladybug_Ladybug()  # -> Vviiiiiiiiiizzz; plug-in component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
brep = Brep([<brep referenced from the Rhino model> x2])
ground = Brep([<brep referenced from the Rhino model> x2])
wires = BrepWireframe(Brep=[ground, brep], Density=-1)
sunpath = Ladybug_SunPath(
    location=importepw.location,
    hour=Slider(14, range=0..100),
    day=Slider(14, range=0..100),
    month=Slider(2, range=0..100),
    timeStep=1,
    sunPathScale=Slider(0.5, range=0..1),
    dailyOrAnnualSunPath=True)  # -> readMe, sunVectors, sunAltitudes, sunAzimuths, port, sunSpheresMesh, sunPathCrvs, compassCrvs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; plug-in component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
shadowrange = Ladybug_ShadowStudy(geometry=[ground, brep], sunVector=sunpath.sunVectors)  # -> readMe, shadow, shade; plug-in component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
mesh = Mesh(shadowrange.shadow)
boundary = BoundarySurfaces(Edges=shadowrange.shadow)
boundary_2 = BoundarySurfaces(Edges=shadowrange.shade)
mesh_2 = Mesh(shadowrange.shade)
number_slider = Slider(0.5, range=0..1)
join = BrepJoin(Breps=boundary)  # -> Breps, Closed
join_2 = BrepJoin(Breps=boundary_2)  # -> Breps, Closed
fmerge = MergeFaces(Brep=join.Breps)  # -> Breps, Before, After
fmerge_2 = MergeFaces(Brep=join_2.Breps)  # -> Breps, Before, After
material = CreateMaterial(
    Diffuse=ColourSwatch(SwatchColor=RGB(168, 32, 32)),
    Specular=RGB(255, 255, 255),
    Emission=RGB(0, 0, 0),
    Transparency=number_slider,
    Shine=0)
material_2 = CreateMaterial(
    Diffuse=ColourSwatch(SwatchColor=RGB(98, 159, 179)),
    Specular=RGB(255, 255, 255),
    Emission=RGB(0, 0, 0),
    Transparency=number_slider,
    Shine=0)
shadow = CustomPreview(Geometry=mesh_2, Shader=material)
shade = CustomPreview(Geometry=mesh, Shader=material_2)
