# Grasshopper definition weatherFile_Sunpath_SolarRad.gh (Grasshopper 1.0.6)

ladybug = Ladybug_Ladybug()  # -> Vviiiiiiiiiizzz; plug-in component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
pipeline = GeometryPipeline(
    GroupByLayer=False,
    GroupByType=False,
    IncludeHidden=True,
    IncludeLocked=True,
    LayerFilter="Default",
    NameFilter="*",
    SublayerFiltering=True,
    TypeFilter=1073741848)
open_weather_file = Ladybug_OpenEPWWeatherFile(open=Toggle(True))  # -> epwFile; plug-in component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
panel = Panel(ladybug)
panel_2 = Panel(pipeline)
gencumulativeskymtx = Ladybug_GenCumulativeSkyMtx(epwFile=open_weather_file, skyDensity=0, useOldRes=True, runIt=Toggle(True))  # -> readMe, cumulativeSkyMtx; plug-in component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
importepw = Ladybug_ImportEpw(epwFile=open_weather_file)  # -> readMe, latitude, location, dryBulbTemperature, dewPointTemperature, relativeHumidity, windSpeed, windDirection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; plug-in component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
analysisperiod = Ladybug_AnalysisPeriod(
    fromMonth=Slider(4, range=1..12),
    fromDay=Slider(1, range=1..31),
    fromHour=Slider(1, range=1..24),
    toMonth=Slider(4, range=1..12),
    toDay=Slider(1, range=1..31),
    toHour=Slider(23, range=1..24))  # -> readMe, analysisPeriod; plug-in component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
grp = Group()
geo = Geometry()
panel_3 = Panel(gencumulativeskymtx.readMe)
panel_4 = Panel(importepw.readMe)
selectskymtx = Ladybug_selectSkyMtx(
    cumulativeSkyMtx=gencumulativeskymtx.cumulativeSkyMtx,
    analysisPeriod=analysisperiod.analysisPeriod,
    removeDiffuse=False,
    removeDirect=False)  # -> readMe, selectedSkyMtx; plug-in component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
sunpath = Ladybug_SunPath(
    location=importepw.location,
    hour=12,
    day=21,
    month=12,
    timeStep=1,
    sunPathScale=Slider(0, range=0..10),
    sunScale=Slider(1.77, range=0..10),
    dailyOrAnnualSunPath=True)  # -> readMe, sunVectors, sunAltitudes, sunAzimuths, port, sunSpheresMesh, sunPathCrvs, compassCrvs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; plug-in component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
panel_5 = Panel(selectskymtx.selectedSkyMtx)
radiationanalysis = Ladybug_RadiationAnalysis(
    geometry=flatten(pipeline),
    gridSize="0.5",
    disFromBase="0.5",
    selectedSkyMtx=flatten(selectskymtx.selectedSkyMtx),
    parallel=Toggle(True),
    runIt=Toggle(True),
    bakeIt="2")  # -> readMe, contextMesh, analysisMesh, testPts, testVec, port, radiationResult, radiationMesh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; plug-in component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
radiationrose = Ladybug_RadiationRose(selectedSkyMtx=selectskymtx.selectedSkyMtx, arrowHeadScale=1, runIt=Toggle(False))  # -> readMe, radiationArrowsMesh, radRoseBaseCrvs, legend, legendBasePts, radRoseEndPts, radRoseValues; plug-in component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
pt = Point()
skydome = Ladybug_SkyDome(selectedSkyMtx=selectskymtx.selectedSkyMtx, scale=Slider(4.3, range=0..10), showTotalOnly=False, runIt=Toggle(False))  # -> readMe, skyPatchesMesh, baseCrvs, altitudeCrvs, legend, legendBasePts, skyPatchesCenPts, skyPatchesAreas, skyPatchesAsBrep, values; plug-in component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
panel_6 = Panel(radiationanalysis.readMe)
mesh = Mesh(radiationanalysis.radiationMesh)
vdis = VectorDisplay(Anchor=radiationanalysis.testPts, Vector=radiationanalysis.testVec)  # disabled
